# Grasshopper definition GhostGPU-Attractors.gh (Grasshopper 1.0.8)

upmsh = UploadMesh(Mesh=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)
mverts = MeshVerticesGPU(Mesh=upmsh)
uppts = UploadPoints(Points=[Point(8, 8, 6), Point(24, 24, 10)])
clspt = ClosestPointGPU(Queries=mverts, Targets=uppts)  # -> Points, Indices, Distances
v2pt = Vector2PtGPU(PointA=mverts, PointB=clspt.Points, Unitize=False)  # -> Vector, Length
bnd = BoundsGPU(Numbers=clspt.Distances)
remap = RemapNumbersGPU(Values=clspt.Distances, SourceBounds=bnd, TargetMin=0, TargetMax=1)
amp = AmplitudeGPU(Vector=v2pt.Vector, Amplitude=remap)
mdisp = MeshDisplaceGPU(Mesh=upmsh, Vectors=amp)
ramp = ColourRampGPU(Scalars=remap, LowColour=RGB(0, 0, 255), HighColour=RGB(255, 0, 0))
mcol = MeshColoursGPU(Mesh=mdisp, Colours=ramp)
down = DownloadGPU(Mesh=mcol)  # -> Points, Vectors, Numbers, Indices, Colours, Meshes
gpudiag = GPUPreviewDiagnostics(Geometry=mcol, EnablePreview=True)  # -> Diagnostics, ActiveBytes, LiveAllocations, DeviceName
