# Grasshopper definition GhostGPU-Benchmark-GPU-vs-CPU.gh (Grasshopper 1.0.8)
# plug-ins: GhostGPU

# ---- group: 0 | SHARED INPUTS (drive both lanes)
# NOTE Title: GhostGPU benchmark: GPU lane (GhostGPU) vs CPU lane (native GH), same shared inputs.
# Open Display > Canvas Widgets > Profiler to see per-component time. GPU groups are green, CPU groups blue, shared inputs yellow, verification grey.
# Section 1 attractor field: heaviness = Mesh Res^2 vertices x Attractors.
# Section 2 solid booleans: Hole Grid M^2 capped cylinders, M^2 domes, Union Spheres N.
# Section 3 mesh booleans: same operands meshed; Bool Mesh Res drives slab/sphere tessellation.
# CPU results are offset by 'CPU Offset' in X for side-by-side preview.
# First GPU solve after opening includes ILGPU kernel JIT (cold); recompute (F5) for warm numbers.
mesh_res = Slider(300, range=10..700)
attractors = Slider(64, range=1..1000)
seed = Slider(7, range=0..100)
pull = Slider(6, range=0..20)
ramp_low_30_60_200 = ColourRGB(Alpha=255, Red=30, Green=60, Blue=200, rhinomcp_alias="col0", rhinomcp_graph_id="MCPGraph_20261017162807833")
ramp_high_255_140_0 = ColourRGB(Alpha=255, Red=255, Green=140, Blue=0, rhinomcp_alias="col1", rhinomcp_graph_id="MCPGraph_20261017162807833")
hole_grid_m = Slider(6, range=2..8)
union_spheres_n = Slider(10, range=2..30)
bool_mesh_res = Slider(24, range=4..32)
cpu_offset = Slider(120, range=0..500)

# ---- group: 1 | Attractor operands (shared)
mesh_origin = ConstructPoint(XCoordinate=0, YCoordinate=-150, ZCoordinate=0, rhinomcp_alias="pt_mo", rhinomcp_graph_id="MCPGraph_20261017162807833")
_0_100 = ConstructDomain(DomainStart=0, DomainEnd=100, rhinomcp_alias="dom100", rhinomcp_graph_id="MCPGraph_20261017162807833")
attr_box_a = ConstructPoint(XCoordinate=0, YCoordinate=-150, ZCoordinate=8, rhinomcp_alias="pt_a", rhinomcp_graph_id="MCPGraph_20261017162807833")
attr_box_b = ConstructPoint(XCoordinate=100, YCoordinate=-50, ZCoordinate=25, rhinomcp_alias="pt_b", rhinomcp_graph_id="MCPGraph_20261017162807833")
mesh_boundary = Rectangle(
    Plane=mesh_origin,
    XSize=_0_100,
    YSize=_0_100,
    Radius=0,
    rhinomcp_alias="rect",
    rhinomcp_graph_id="MCPGraph_20261017162807833")  # -> Rectangle, Length
attr_region = Box2Pt(
    PointA=attr_box_a,
    PointB=attr_box_b,
    Plane=PlaneXY(0, 0, 0),
    rhinomcp_alias="abox",
    rhinomcp_graph_id="MCPGraph_20261017162807833")
dense_mesh = MeshPlane(
    Boundary=mesh_boundary.Rectangle,
    WidthCount=mesh_res,
    HeightCount=mesh_res,
    rhinomcp_alias="mplane",
    rhinomcp_graph_id="MCPGraph_20261017162807833")  # -> Mesh, Area
attractor_pts = Populate3D(Region=attr_region, Count=attractors, Seed=seed, rhinomcp_alias="pop", rhinomcp_graph_id="MCPGraph_20261017162807833")

# ---- group: 2 | Solid boolean operands (shared)
cell_size = Expression(x=hole_grid_m, Expression="100/x", rhinomcp_alias="e_s", rhinomcp_graph_id="MCPGraph_20261017163212382")
half_cell = Expression(x=hole_grid_m, Expression="50/x", rhinomcp_alias="e_h", rhinomcp_graph_id="MCPGraph_20261017163212382")
grid_ext = Expression(x=hole_grid_m, Expression="x-1", rhinomcp_alias="e_ex", rhinomcp_graph_id="MCPGraph_20261017163212382")
cutter_r = Expression(x=hole_grid_m, Expression="30/x", rhinomcp_alias="e_rc", rhinomcp_graph_id="MCPGraph_20261017163212382")
dome_r = Expression(x=hole_grid_m, Expression="40/x", rhinomcp_alias="e_rs", rhinomcp_graph_id="MCPGraph_20261017163212382")
down_10 = VectorXYZ(XComponent=0, YComponent=0, ZComponent=-10, rhinomcp_alias="v_dn", rhinomcp_graph_id="MCPGraph_20261017163212382")  # -> Vector, Length
dome_lift_z_3 = VectorXYZ(XComponent=0, YComponent=0, ZComponent=3, rhinomcp_alias="v_up", rhinomcp_graph_id="MCPGraph_20261017163212382")  # -> Vector, Length
slab_center = ConstructPoint(XCoordinate=50, YCoordinate=50, ZCoordinate=0, rhinomcp_alias="pt_c", rhinomcp_graph_id="MCPGraph_20261017163212382")
union_x = Series(Start=0, Step=4, Count=union_spheres_n, rhinomcp_alias="ser", rhinomcp_graph_id="MCPGraph_20261017163212382")
grid_origin = ConstructPoint(
    XCoordinate=half_cell,
    YCoordinate=half_cell,
    ZCoordinate=0,
    rhinomcp_alias="pt_g",
    rhinomcp_graph_id="MCPGraph_20261017163212382")
slab = CenterBox(Base=slab_center, X=50, Y=50, Z=5, rhinomcp_alias="slab", rhinomcp_graph_id="MCPGraph_20261017163212382")
union_centers = ConstructPoint(
    XCoordinate=union_x,
    YCoordinate=-20,
    ZCoordinate=0,
    rhinomcp_alias="pt_u",
    rhinomcp_graph_id="MCPGraph_20261017163212382")
hole_grid = Square(
    Plane=grid_origin,
    Size=cell_size,
    ExtentX=grid_ext,
    ExtentY=grid_ext,
    rhinomcp_alias="sq",
    rhinomcp_graph_id="MCPGraph_20261017163212382")  # -> Cells, Points
union_spheres = Sphere(Base=union_centers, Radius=3, rhinomcp_alias="sph_u", rhinomcp_graph_id="MCPGraph_20261017163212382")
hole_pts = FlattenTree(Tree=hole_grid.Points, Path="{0}", rhinomcp_alias="fl", rhinomcp_graph_id="MCPGraph_20261017163212382")
cutter_bases = Move(Geometry=hole_pts, Motion=down_10.Vector, rhinomcp_alias="mv_c", rhinomcp_graph_id="MCPGraph_20261017163212382")  # -> Geometry, Transform
dome_centers = Move(Geometry=hole_pts, Motion=dome_lift_z_3.Vector, rhinomcp_alias="mv_s", rhinomcp_graph_id="MCPGraph_20261017163212382")  # -> Geometry, Transform
cutter_cyl = Cylinder(
    Base=cutter_bases.Geometry,
    Radius=cutter_r,
    Length=20,
    rhinomcp_alias="cyl",
    rhinomcp_graph_id="MCPGraph_20261017163212382")
domes = Sphere(Base=dome_centers.Geometry, Radius=dome_r, rhinomcp_alias="sph", rhinomcp_graph_id="MCPGraph_20261017163212382")
cutters_capped = CapHoles(Brep=cutter_cyl, rhinomcp_alias="cap", rhinomcp_graph_id="MCPGraph_20261017163212382")

# ---- group: 3 | Mesh boolean operands (shared)
slab_mesh = MeshBox(
    Base=slab,
    XCount=bool_mesh_res,
    YCount=bool_mesh_res,
    ZCount=4,
    rhinomcp_alias="mb_slab",
    rhinomcp_graph_id="MCPGraph_20261017163212382")
cutter_meshes = MeshBrep(
    Brep=cutters_capped,
    Settings={GridMaxCount=0, GridMinCount=16, JaggedSeams=False, MaxEdgeLength=0, MinEdgeLength=0.0001, MinTolerance=0, Refine=True, RefineAngle=0, RelativeTolerance=0.65, SimplePlanes=True, Tolerance=0},
    rhinomcp_alias="mb_cut",
    rhinomcp_graph_id="MCPGraph_20261017163212382")
dome_meshes = MeshSphere(
    Base=dome_centers.Geometry,
    Radius=dome_r,
    UCount=bool_mesh_res,
    VCount=bool_mesh_res,
    rhinomcp_alias="ms_dome",
    rhinomcp_graph_id="MCPGraph_20261017163212382")
union_sphere_meshes = MeshSphere(
    Base=union_centers,
    Radius=3,
    UCount=bool_mesh_res,
    VCount=bool_mesh_res,
    rhinomcp_alias="ms_u",
    rhinomcp_graph_id="MCPGraph_20261017163212382")

# ---- group: 1 | GPU LANE - Attractor field
gpu_upmesh = UploadMesh(Mesh=dense_mesh.Mesh, rhinomcp_alias="g_upm", rhinomcp_graph_id="MCPGraph_20261017162807833")
gpu_upattr = UploadPoints(Points=attractor_pts, rhinomcp_alias="g_upa", rhinomcp_graph_id="MCPGraph_20261017162807833")
gpu_uppull = UploadNumbers(Numbers=pull, rhinomcp_alias="g_uph", rhinomcp_graph_id="MCPGraph_20261017162807833")
gpu_mverts = MeshVerticesGPU(Mesh=gpu_upmesh, rhinomcp_alias="g_mv", rhinomcp_graph_id="MCPGraph_20261017162807833")
gpu_clspt = ClosestPointGPU(Queries=gpu_mverts, Targets=gpu_upattr, rhinomcp_alias="g_cp", rhinomcp_graph_id="MCPGraph_20261017162807833")  # -> Points, Indices, Distances
gpu_bounds = BoundsGPU(Numbers=gpu_clspt.Distances, rhinomcp_alias="g_bnd", rhinomcp_graph_id="MCPGraph_20261017162807833")
gpu_v2pt = Vector2PtGPU(
    PointA=gpu_mverts,
    PointB=gpu_clspt.Points,
    Unitize=False,
    rhinomcp_alias="g_v2",
    rhinomcp_graph_id="MCPGraph_20261017162807833")  # -> Vector, Length
gpu_remap = RemapNumbersGPU(
    Values=gpu_clspt.Distances,
    SourceBounds=gpu_bounds,
    TargetMin=1,
    TargetMax=0,
    rhinomcp_alias="g_rmp",
    rhinomcp_graph_id="MCPGraph_20261017162807833")
gpu_smoothstep = FunctionMapGPU(Values=gpu_remap, Function=1, rhinomcp_alias="g_map", rhinomcp_graph_id="MCPGraph_20261017162807833")
gpu_ampmul = ScalarMathGPU(
    BufferA=gpu_smoothstep,
    BufferB=gpu_uppull,
    Operation=2,
    rhinomcp_alias="g_mul",
    rhinomcp_graph_id="MCPGraph_20261017162807833")
gpu_amp = AmplitudeGPU(Vector=gpu_v2pt.Vector, Amplitude=gpu_ampmul, rhinomcp_alias="g_amp", rhinomcp_graph_id="MCPGraph_20261017162807833")
gpu_displace = MeshDisplaceGPU(Mesh=gpu_upmesh, Vectors=gpu_amp, rhinomcp_alias="g_disp", rhinomcp_graph_id="MCPGraph_20261017162807833")
gpu_ramp = ColourRampGPU(
    Scalars=gpu_smoothstep,
    LowColour=ramp_low_30_60_200,
    HighColour=ramp_high_255_140_0,
    rhinomcp_alias="g_ramp",
    rhinomcp_graph_id="MCPGraph_20261017162807833")
gpu_mcol = MeshColoursGPU(Mesh=gpu_displace, Colours=gpu_ramp, rhinomcp_alias="g_mcol", rhinomcp_graph_id="MCPGraph_20261017162807833")
gpu_attractor_result = DownloadGPU(Mesh=gpu_mcol, rhinomcp_alias="g_down", rhinomcp_graph_id="MCPGraph_20261017162807833")  # -> Points, Vectors, Numbers, Indices, Colours, Meshes

# ---- group: 1 | CPU LANE - Attractor field
cpu_demesh = DeconstructMesh(Mesh=dense_mesh.Mesh, rhinomcp_alias="c_dm", rhinomcp_graph_id="MCPGraph_20261017162807833")  # -> Vertices, Faces, Colours, Normals
cpu_target_1_0 = ConstructDomain(DomainStart=1, DomainEnd=0, rhinomcp_alias="c_dom", rhinomcp_graph_id="MCPGraph_20261017162807833")
cpu_clspt = ClosestPoint(Point=cpu_demesh.Vertices, Cloud=attractor_pts, rhinomcp_alias="c_cp", rhinomcp_graph_id="MCPGraph_20261017162807833")  # -> ClosestPoint, CPIndex, Distance
cpu_bounds = Bounds(Numbers=cpu_clspt.Distance, rhinomcp_alias="c_bnd", rhinomcp_graph_id="MCPGraph_20261017162807833")
cpu_v2pt = Vector2Pt(
    PointA=cpu_demesh.Vertices,
    PointB=cpu_clspt.ClosestPoint,
    Unitize=False,
    rhinomcp_alias="c_v2",
    rhinomcp_graph_id="MCPGraph_20261017162807833")  # -> Vector, Length
cpu_remap = RemapNumbers(
    Value=cpu_clspt.Distance,
    Source=cpu_bounds,
    Target=cpu_target_1_0,
    rhinomcp_alias="c_rmp",
    rhinomcp_graph_id="MCPGraph_20261017162807833")  # -> Mapped, Clipped
cpu_smoothstep = Expression(x=cpu_remap.Clipped, Expression="x*x*(3-2*x)", rhinomcp_alias="c_ss", rhinomcp_graph_id="MCPGraph_20261017162807833")
cpu_ampmul = Multiplication(A=cpu_smoothstep, B=pull, rhinomcp_alias="c_mul", rhinomcp_graph_id="MCPGraph_20261017162807833")
cpu_rampr = Expression(x=cpu_smoothstep, Expression="30+225*x", rhinomcp_alias="c_er", rhinomcp_graph_id="MCPGraph_20261017162807833")
cpu_rampg = Expression(x=cpu_smoothstep, Expression="60+80*x", rhinomcp_alias="c_eg", rhinomcp_graph_id="MCPGraph_20261017162807833")
cpu_rampb = Expression(x=cpu_smoothstep, Expression="200-200*x", rhinomcp_alias="c_eb", rhinomcp_graph_id="MCPGraph_20261017162807833")
cpu_amp = Amplitude(Vector=cpu_v2pt.Vector, Amplitude=cpu_ampmul, rhinomcp_alias="c_amp", rhinomcp_graph_id="MCPGraph_20261017162807833")
cpu_movepts = Move(Geometry=cpu_demesh.Vertices, Motion=cpu_amp, rhinomcp_alias="c_mvp", rhinomcp_graph_id="MCPGraph_20261017162807833")  # -> Geometry, Transform
cpu_colour = ColourRGB(
    Alpha=255,
    Red=cpu_rampr,
    Green=cpu_rampg,
    Blue=cpu_rampb,
    rhinomcp_alias="c_rgb",
    rhinomcp_graph_id="MCPGraph_20261017162807833")
cpu_conmesh = ConstructMesh(
    Vertices=cpu_movepts.Geometry,
    Faces=cpu_demesh.Faces,
    Colours=cpu_colour,
    rhinomcp_alias="c_cm",
    rhinomcp_graph_id="MCPGraph_20261017162807833")

# ---- group: 4 | GPU SESSION SETTINGS + DIAGNOSTICS
# NOTE HostThresh: HostThresh = element count below which GhostGPU runs an op on the host (CPU) instead of launching a GPU kernel.
# Default 65536 keeps small jobs on the CPU (avoids launch/transfer overhead).
# Set HostThresh = 0 to force every op onto the GPU device.
# Diagnostics panel: 'Kernel Dispatches' = device launches, 'Host Dispatches' = ops run on the host.
# Changing any Session Settings input recreates the GPU session (next solve is cold again).
memmb = Slider(1024, range=128..8192)
poolmb = Slider(256, range=0..2048)
hostthresh = Slider(65536, range=0..1000000)
gpu_diagnostics = GPUPreviewDiagnostics(Geometry=gpu_mcol, EnablePreview=False, rhinomcp_alias="diag", rhinomcp_graph_id="MCPGraph_20261017162807833")  # -> Diagnostics, ActiveBytes, LiveAllocations, DeviceName
gpu_session_settings = GPUSessionSettings(
    MemoryLimitMB=memmb,
    PoolCacheMB=poolmb,
    StagingSlots=4,
    StagingSlotMB=16,
    HostThreshold=hostthresh,
    SpillToHost=True,
    DefaultVectorFormat="V3D",
    DefaultScalarFormat="F64",
    Backend="CudaOnly",
    rhinomcp_alias="gs",
    rhinomcp_graph_id="MCPGraph_20261017162807833")  # -> SessionInfo, SessionID
diagnostics = Panel(gpu_diagnostics.Diagnostics)
session_info = Panel(gpu_session_settings.SessionInfo)

# ---- group: 2 | CPU LANE - Solid booleans
cpu_sdiff = SolidDifference(BrepsA=slab, BrepsB=cutters_capped, rhinomcp_alias="cpu_SDiff", rhinomcp_graph_id="MCPGraph_20261017163212382")
cpu_sunion = SolidUnion(Breps=union_spheres, rhinomcp_alias="cpu_SUnion", rhinomcp_graph_id="MCPGraph_20261017163212382")
cpu_sint = SolidIntersection(BrepsA=slab, BrepsB=domes, rhinomcp_alias="cpu_SInt", rhinomcp_graph_id="MCPGraph_20261017163212382")

# ---- group: 3 | GPU LANE - Mesh booleans
gpu_mdiff = MeshDifferenceGPU(MeshesA=slab_mesh, MeshesB=cutter_meshes, rhinomcp_alias="gpu_MDiff", rhinomcp_graph_id="MCPGraph_20261017163212382")
gpu_munion = MeshUnionGPU(Meshes=union_sphere_meshes, rhinomcp_alias="gpu_MUnion", rhinomcp_graph_id="MCPGraph_20261017163212382")
gpu_mint = MeshIntersectionGPU(MeshesA=slab_mesh, MeshesB=dome_meshes, rhinomcp_alias="gpu_MInt", rhinomcp_graph_id="MCPGraph_20261017163212382")

# ---- group: 3 | CPU LANE - Mesh booleans
cpu_mdiff = MeshDifference(MeshesA=slab_mesh, MeshesB=cutter_meshes, rhinomcp_alias="cpu_MDiff", rhinomcp_graph_id="MCPGraph_20261017163212382")
cpu_munion = MeshUnion(Meshes=union_sphere_meshes, rhinomcp_alias="cpu_MUnion", rhinomcp_graph_id="MCPGraph_20261017163212382")
cpu_mint = MeshIntersection(MeshesA=slab_mesh, MeshesB=dome_meshes, rhinomcp_alias="cpu_MInt", rhinomcp_graph_id="MCPGraph_20261017163212382")

# ---- group: 5 | VERIFY 1 - attractor mesh deviation
ver_gpu_demesh = DeconstructMesh(Mesh=gpu_attractor_result.Meshes, rhinomcp_alias="x_dm", rhinomcp_graph_id="MCPGraph_20261017162807833")  # -> Vertices, Faces, Colours, Normals
ver_dist = Distance(
    PointA=ver_gpu_demesh.Vertices,
    PointB=cpu_movepts.Geometry,
    rhinomcp_alias="x_dist",
    rhinomcp_graph_id="MCPGraph_20261017162807833")
ver_dev_bounds = Bounds(Numbers=ver_dist, rhinomcp_alias="x_bnd", rhinomcp_graph_id="MCPGraph_20261017162807833")
max_vertex_deviation_gpu_vs_cpu = Panel(ver_dev_bounds)

# ---- group: Brep kernel switch (GhostGPU / RhinoCommon)
# Brep kernel for the GPU Solid booleans: type GhostGPU (our own SSI/split/join, falls back to RhinoCommon per pair with a warning) or RhinoCommon (Rhino's intersect/split/join + GPU classification). Compare GPU SDiff/SUnion/SInt times against the CPU lane.
panel = Panel("GhostGPU")

# ---- group: Brep kernel switch (GhostGPU / RhinoCommon) / 2 | GPU LANE - Solid booleans
gpu_sdiff = SolidDifferenceGPU(
    BrepsA=slab,
    BrepsB=cutters_capped,
    Kernel=panel,
    rhinomcp_alias="gpu_SDiff",
    rhinomcp_graph_id="MCPGraph_20261017163212382")
gpu_sunion = SolidUnionGPU(Breps=union_spheres, Kernel=panel, rhinomcp_alias="gpu_SUnion", rhinomcp_graph_id="MCPGraph_20261017163212382")
gpu_sint = SolidIntersectionGPU(BrepsA=slab, BrepsB=domes, Kernel=panel, rhinomcp_alias="gpu_SInt", rhinomcp_graph_id="MCPGraph_20261017163212382")

# ---- group: 5 | VERIFY 2+3 - boolean volumes & counts
ver_gpu_sdiff_vol = Volume(Geometry=gpu_sdiff, rhinomcp_alias="gpu_SDiff_vol", rhinomcp_graph_id="MCPGraph_20261017163212382")  # -> Volume, Centroid
ver_gpu_sdiff_count = ListLength(List=gpu_sdiff, rhinomcp_alias="gpu_SDiff_len", rhinomcp_graph_id="MCPGraph_20261017163212382")
ver_cpu_sdiff_vol = Volume(Geometry=cpu_sdiff, rhinomcp_alias="cpu_SDiff_vol", rhinomcp_graph_id="MCPGraph_20261017163212382")  # -> Volume, Centroid
ver_cpu_sdiff_count = ListLength(List=cpu_sdiff, rhinomcp_alias="cpu_SDiff_len", rhinomcp_graph_id="MCPGraph_20261017163212382")
ver_gpu_sunion_vol = Volume(Geometry=gpu_sunion, rhinomcp_alias="gpu_SUnion_vol", rhinomcp_graph_id="MCPGraph_20261017163212382")  # -> Volume, Centroid
ver_gpu_sunion_count = ListLength(List=gpu_sunion, rhinomcp_alias="gpu_SUnion_len", rhinomcp_graph_id="MCPGraph_20261017163212382")
ver_cpu_sunion_vol = Volume(Geometry=cpu_sunion, rhinomcp_alias="cpu_SUnion_vol", rhinomcp_graph_id="MCPGraph_20261017163212382")  # -> Volume, Centroid
ver_cpu_sunion_count = ListLength(List=cpu_sunion, rhinomcp_alias="cpu_SUnion_len", rhinomcp_graph_id="MCPGraph_20261017163212382")
ver_gpu_sint_vol = Volume(Geometry=gpu_sint, rhinomcp_alias="gpu_SInt_vol", rhinomcp_graph_id="MCPGraph_20261017163212382")  # -> Volume, Centroid
ver_gpu_sint_count = ListLength(List=gpu_sint, rhinomcp_alias="gpu_SInt_len", rhinomcp_graph_id="MCPGraph_20261017163212382")
ver_cpu_sint_vol = Volume(Geometry=cpu_sint, rhinomcp_alias="cpu_SInt_vol", rhinomcp_graph_id="MCPGraph_20261017163212382")  # -> Volume, Centroid
ver_cpu_sint_count = ListLength(List=cpu_sint, rhinomcp_alias="cpu_SInt_len", rhinomcp_graph_id="MCPGraph_20261017163212382")
ver_gpu_mdiff_vol = Volume(Geometry=gpu_mdiff, rhinomcp_alias="gpu_MDiff_vol", rhinomcp_graph_id="MCPGraph_20261017163212382")  # -> Volume, Centroid
ver_gpu_mdiff_count = ListLength(List=gpu_mdiff, rhinomcp_alias="gpu_MDiff_len", rhinomcp_graph_id="MCPGraph_20261017163212382")
ver_cpu_mdiff_vol = Volume(Geometry=cpu_mdiff, rhinomcp_alias="cpu_MDiff_vol", rhinomcp_graph_id="MCPGraph_20261017163212382")  # -> Volume, Centroid
ver_cpu_mdiff_count = ListLength(List=cpu_mdiff, rhinomcp_alias="cpu_MDiff_len", rhinomcp_graph_id="MCPGraph_20261017163212382")
ver_gpu_munion_vol = Volume(Geometry=gpu_munion, rhinomcp_alias="gpu_MUnion_vol", rhinomcp_graph_id="MCPGraph_20261017163212382")  # -> Volume, Centroid
ver_gpu_munion_count = ListLength(List=gpu_munion, rhinomcp_alias="gpu_MUnion_len", rhinomcp_graph_id="MCPGraph_20261017163212382")
ver_cpu_munion_vol = Volume(Geometry=cpu_munion, rhinomcp_alias="cpu_MUnion_vol", rhinomcp_graph_id="MCPGraph_20261017163212382")  # -> Volume, Centroid
ver_cpu_munion_count = ListLength(List=cpu_munion, rhinomcp_alias="cpu_MUnion_len", rhinomcp_graph_id="MCPGraph_20261017163212382")
ver_gpu_mint_vol = Volume(Geometry=gpu_mint, rhinomcp_alias="gpu_MInt_vol", rhinomcp_graph_id="MCPGraph_20261017163212382")  # -> Volume, Centroid
ver_gpu_mint_count = ListLength(List=gpu_mint, rhinomcp_alias="gpu_MInt_len", rhinomcp_graph_id="MCPGraph_20261017163212382")
ver_cpu_mint_vol = Volume(Geometry=cpu_mint, rhinomcp_alias="cpu_MInt_vol", rhinomcp_graph_id="MCPGraph_20261017163212382")  # -> Volume, Centroid
ver_cpu_mint_count = ListLength(List=cpu_mint, rhinomcp_alias="cpu_MInt_len", rhinomcp_graph_id="MCPGraph_20261017163212382")
ver_gpu_sdiff_sumvol = MassAddition(Input=ver_gpu_sdiff_vol.Volume, rhinomcp_alias="gpu_SDiff_ma", rhinomcp_graph_id="MCPGraph_20261017163212382")  # -> Result, PartialResults
ver_cpu_sdiff_sumvol = MassAddition(Input=ver_cpu_sdiff_vol.Volume, rhinomcp_alias="cpu_SDiff_ma", rhinomcp_graph_id="MCPGraph_20261017163212382")  # -> Result, PartialResults
ver_gpu_sunion_sumvol = MassAddition(Input=ver_gpu_sunion_vol.Volume, rhinomcp_alias="gpu_SUnion_ma", rhinomcp_graph_id="MCPGraph_20261017163212382")  # -> Result, PartialResults
ver_cpu_sunion_sumvol = MassAddition(Input=ver_cpu_sunion_vol.Volume, rhinomcp_alias="cpu_SUnion_ma", rhinomcp_graph_id="MCPGraph_20261017163212382")  # -> Result, PartialResults
ver_gpu_sint_sumvol = MassAddition(Input=ver_gpu_sint_vol.Volume, rhinomcp_alias="gpu_SInt_ma", rhinomcp_graph_id="MCPGraph_20261017163212382")  # -> Result, PartialResults
ver_cpu_sint_sumvol = MassAddition(Input=ver_cpu_sint_vol.Volume, rhinomcp_alias="cpu_SInt_ma", rhinomcp_graph_id="MCPGraph_20261017163212382")  # -> Result, PartialResults
ver_gpu_mdiff_sumvol = MassAddition(Input=ver_gpu_mdiff_vol.Volume, rhinomcp_alias="gpu_MDiff_ma", rhinomcp_graph_id="MCPGraph_20261017163212382")  # -> Result, PartialResults
ver_cpu_mdiff_sumvol = MassAddition(Input=ver_cpu_mdiff_vol.Volume, rhinomcp_alias="cpu_MDiff_ma", rhinomcp_graph_id="MCPGraph_20261017163212382")  # -> Result, PartialResults
ver_gpu_munion_sumvol = MassAddition(Input=ver_gpu_munion_vol.Volume, rhinomcp_alias="gpu_MUnion_ma", rhinomcp_graph_id="MCPGraph_20261017163212382")  # -> Result, PartialResults
ver_cpu_munion_sumvol = MassAddition(Input=ver_cpu_munion_vol.Volume, rhinomcp_alias="cpu_MUnion_ma", rhinomcp_graph_id="MCPGraph_20261017163212382")  # -> Result, PartialResults
ver_gpu_mint_sumvol = MassAddition(Input=ver_gpu_mint_vol.Volume, rhinomcp_alias="gpu_MInt_ma", rhinomcp_graph_id="MCPGraph_20261017163212382")  # -> Result, PartialResults
ver_cpu_mint_sumvol = MassAddition(Input=ver_cpu_mint_vol.Volume, rhinomcp_alias="cpu_MInt_ma", rhinomcp_graph_id="MCPGraph_20261017163212382")  # -> Result, PartialResults
sdiff_gpu_vol_cpu_vol_gpu_n_cpu_n = Panel([ver_gpu_sdiff_sumvol.Result, ver_cpu_sdiff_sumvol.Result, ver_gpu_sdiff_count, ver_cpu_sdiff_count])
sunion_gpu_vol_cpu_vol_gpu_n_cpu_n = Panel([ver_gpu_sunion_sumvol.Result, ver_cpu_sunion_sumvol.Result, ver_gpu_sunion_count, ver_cpu_sunion_count])
sint_gpu_vol_cpu_vol_gpu_n_cpu_n = Panel([ver_gpu_sint_sumvol.Result, ver_cpu_sint_sumvol.Result, ver_gpu_sint_count, ver_cpu_sint_count])
mdiff_gpu_vol_cpu_vol_gpu_n_cpu_n = Panel([ver_gpu_mdiff_sumvol.Result, ver_cpu_mdiff_sumvol.Result, ver_gpu_mdiff_count, ver_cpu_mdiff_count])
munion_gpu_vol_cpu_vol_gpu_n_cpu_n = Panel([ver_gpu_munion_sumvol.Result, ver_cpu_munion_sumvol.Result, ver_gpu_munion_count, ver_cpu_munion_count])
mint_gpu_vol_cpu_vol_gpu_n_cpu_n = Panel([ver_gpu_mint_sumvol.Result, ver_cpu_mint_sumvol.Result, ver_gpu_mint_count, ver_cpu_mint_count])

# ---- group: 6 | PREVIEW OFFSETS (display only)
cpu_offset_vec = VectorXYZ(
    XComponent=cpu_offset,
    YComponent=0,
    ZComponent=0,
    rhinomcp_alias="v_off",
    rhinomcp_graph_id="MCPGraph_20261017162807833")  # -> Vector, Length
cpu_bool_vec = VectorXYZ(XComponent=cpu_offset, YComponent=0, ZComponent=0, rhinomcp_alias="v_c", rhinomcp_graph_id="MCPGraph_20261017163212382")  # -> Vector, Length
cpu_int_vec = VectorXYZ(
    XComponent=cpu_offset,
    YComponent=0,
    ZComponent=25,
    rhinomcp_alias="v_ci",
    rhinomcp_graph_id="MCPGraph_20261017163212382")  # -> Vector, Length
cpu_mesh_vec = VectorXYZ(
    XComponent=cpu_offset,
    YComponent=160,
    ZComponent=0,
    rhinomcp_alias="v_cm",
    rhinomcp_graph_id="MCPGraph_20261017163212382")  # -> Vector, Length
cpu_mesh_int_vec = VectorXYZ(
    XComponent=cpu_offset,
    YComponent=160,
    ZComponent=25,
    rhinomcp_alias="v_cmi",
    rhinomcp_graph_id="MCPGraph_20261017163212382")  # -> Vector, Length
lift_int = VectorXYZ(XComponent=0, YComponent=0, ZComponent=25, rhinomcp_alias="v_i", rhinomcp_graph_id="MCPGraph_20261017163212382")  # -> Vector, Length
mesh_row = VectorXYZ(XComponent=0, YComponent=160, ZComponent=0, rhinomcp_alias="v_m", rhinomcp_graph_id="MCPGraph_20261017163212382")  # -> Vector, Length
mesh_row_int = VectorXYZ(XComponent=0, YComponent=160, ZComponent=25, rhinomcp_alias="v_mi", rhinomcp_graph_id="MCPGraph_20261017163212382")  # -> Vector, Length
cpu_attractor_result = Move(
    Geometry=cpu_conmesh,
    Motion=cpu_offset_vec.Vector,
    rhinomcp_alias="c_show",
    rhinomcp_graph_id="MCPGraph_20261017162807833")  # -> Geometry, Transform
cpu_sdiff_result = Move(
    Geometry=cpu_sdiff,
    Motion=cpu_bool_vec.Vector,
    rhinomcp_alias="cpu_SDiff_show",
    rhinomcp_graph_id="MCPGraph_20261017163212382")  # -> Geometry, Transform
cpu_sunion_result = Move(
    Geometry=cpu_sunion,
    Motion=cpu_bool_vec.Vector,
    rhinomcp_alias="cpu_SUnion_show",
    rhinomcp_graph_id="MCPGraph_20261017163212382")  # -> Geometry, Transform
cpu_sint_result = Move(
    Geometry=cpu_sint,
    Motion=cpu_int_vec.Vector,
    rhinomcp_alias="cpu_SInt_show",
    rhinomcp_graph_id="MCPGraph_20261017163212382")  # -> Geometry, Transform
gpu_sint_result = Move(
    Geometry=gpu_sint,
    Motion=lift_int.Vector,
    rhinomcp_alias="gpu_SInt_show",
    rhinomcp_graph_id="MCPGraph_20261017163212382")  # -> Geometry, Transform
gpu_mdiff_result = Move(
    Geometry=gpu_mdiff,
    Motion=mesh_row.Vector,
    rhinomcp_alias="gpu_MDiff_show",
    rhinomcp_graph_id="MCPGraph_20261017163212382")  # -> Geometry, Transform
gpu_munion_result = Move(
    Geometry=gpu_munion,
    Motion=mesh_row.Vector,
    rhinomcp_alias="gpu_MUnion_show",
    rhinomcp_graph_id="MCPGraph_20261017163212382")  # -> Geometry, Transform
gpu_mint_result = Move(
    Geometry=gpu_mint,
    Motion=mesh_row_int.Vector,
    rhinomcp_alias="gpu_MInt_show",
    rhinomcp_graph_id="MCPGraph_20261017163212382")  # -> Geometry, Transform
cpu_mdiff_result = Move(
    Geometry=cpu_mdiff,
    Motion=cpu_mesh_vec.Vector,
    rhinomcp_alias="cpu_MDiff_show",
    rhinomcp_graph_id="MCPGraph_20261017163212382")  # -> Geometry, Transform
cpu_munion_result = Move(
    Geometry=cpu_munion,
    Motion=cpu_mesh_vec.Vector,
    rhinomcp_alias="cpu_MUnion_show",
    rhinomcp_graph_id="MCPGraph_20261017163212382")  # -> Geometry, Transform
cpu_mint_result = Move(
    Geometry=cpu_mint,
    Motion=cpu_mesh_int_vec.Vector,
    rhinomcp_alias="cpu_MInt_show",
    rhinomcp_graph_id="MCPGraph_20261017163212382")  # -> Geometry, Transform
