# Grasshopper definition GhostGPU-CPU-vs-GPU.gh (Grasshopper 1.0.8)
# plug-ins: GhostGPU

# ---- group: SHARED INPUTS â€” change these to drive both versions
faces_per_side = Slider(31, range=4..256)
displacement = Slider(6.76, range=0..10)
mplane = MeshPlane(Boundary={Plane=PlaneXY(0, 0, 0), Size=Domain2(u=0..31, v=0..31)}, WidthCount=faces_per_side, HeightCount=faces_per_side)  # -> Mesh, Area
shared_attractors = Point([Point(8.120961305, 8.27, 9.771977238), Point(15.34863914, 24.19, 9.090515778)])

# ---- group: CPU â€” ordinary Grasshopper nodes, same inputs and operations
# How to test: GPU / NATIVE CPU COMPARISON
# 
# 1. Change Faces per side for workload size.
# 2. Change Displacement; both chains use the same value.
# 3. Right-click Shared attractors to edit the points.
# 4. GPU preview downloads explicitly; excluded from timings.
# 5. CPU Mesh Colours preview is initially hidden. Right-click to switch preview.
# 6. Profiler mode is enabled. Use Solution > Recompute.
# 7. Run scripts/BenchmarkCanvas.ps1 after changing inputs for fresh median wall timings.
# 
# Both branches output the same shape and topology. Comparison reports maximum vertex error and colour differences. Equidistant attractors may differ due to floating-point rounding.
demesh = DeconstructMesh(Mesh=mplane.Mesh)  # -> Vertices, Faces, Colours, Normals
cp = ClosestPoint(Point=demesh.Vertices, Cloud=shared_attractors)  # -> ClosestPoint, CPIndex, Distance
vec2pt = Vector2Pt(PointA=demesh.Vertices, PointB=cp.ClosestPoint, Unitize=False)  # -> Vector, Length
bnd = Bounds(Numbers=cp.Distance)
# Last warmed benchmark: WARMED CPU / GPU TIMINGS
# 
# Mesh: 1024 vertices, 961 quads
# Native CPU full: 9.964 ms
# GPU full + transfers: 3.030 ms
# GPU resident + sync: 1.888 ms
# CPU / GPU full ratio: 3.29x
# 
# Median of 9 alternating trials after 3 warmups.
# Shape max error: 3.55e-15 model units
# Colour byte differences: 0
# 
# Full timing includes GH dispatch and Python orchestration. Shared mesh generation and viewport preview excluded.
# 
# These are LAST MEASURED results. After edits, rerun scripts/BenchmarkCanvas.ps1.
# Resident time is informational; compare CPU full against GPU full.
dom = ConstructDomain(DomainStart=0, DomainEnd=displacement)
remap = RemapNumbers(Value=cp.Distance, Source=bnd, Target=dom)  # -> Mapped, Clipped
amp = Amplitude(Vector=vec2pt.Vector, Amplitude=remap.Mapped)
gradient = Gradient(LowerLimit=0, UpperLimit=1, Parameter=remap.Mapped, stops=[0: RGB(0, 0, 255), 1: RGB(255, 0, 0)])
move = Move(Geometry=demesh.Vertices, Motion=amp)  # -> Geometry, Transform
conmesh = ConstructMesh(Vertices=move.Geometry, Faces=demesh.Faces)
mcol = MeshColours(Mesh=conmesh, Colours=gradient)

# ----
gpu_preview_readback = BooleanToggle(True)

# ---- group: GPU â€” resident handles; Download is included in full-path timing
upmsh = UploadMesh(Mesh=mplane.Mesh)
mverts = MeshVerticesGPU(Mesh=upmsh)
uppts = UploadPoints(Points=shared_attractors)
clspt = ClosestPointGPU(Queries=mverts, Targets=uppts)  # -> Points, Indices, Distances
v2pt = Vector2PtGPU(PointA=mverts, PointB=clspt.Points, Unitize=False)  # -> Vector, Length
bnd_2 = BoundsGPU(Numbers=clspt.Distances)
remap_2 = RemapNumbersGPU(Values=clspt.Distances, SourceBounds=bnd_2, TargetMin=0, TargetMax=displacement)
ramp = ColourRampGPU(Scalars=remap_2, LowColour=RGB(0, 0, 255), HighColour=RGB(255, 0, 0))
amp_2 = AmplitudeGPU(Vector=v2pt.Vector, Amplitude=remap_2)
mdisp = MeshDisplaceGPU(Mesh=upmsh, Vectors=amp_2)
mcol_2 = MeshColoursGPU(Mesh=mdisp, Colours=ramp)
down = DownloadGPU(Mesh=mcol_2)  # -> Points, Vectors, Numbers, Indices, Colours, Meshes
gpudiag = GPUPreviewDiagnostics(Geometry=mcol_2, EnablePreview=gpu_preview_readback)  # -> Diagnostics, ActiveBytes, LiveAllocations, DeviceName
