# Grasshopper definition GhostGPU-MemoryConfig.gh (Grasshopper 1.0.8)
# plug-ins: GhostGPU

uppts = UploadPoints(Points=[Point(8, 8, 6), Point(24, 24, 10)])

# ---- group: Memory configuration: 256 MB budget, 64 MB pool, compact V3F/F32 storage
gpusettings = GPUSessionSettings(
    MemoryLimitMB=Slider(256, range=64..4096),
    PoolCacheMB=Slider(64, range=0..1024),
    StagingSlots=4,
    StagingSlotMB=16,
    HostThreshold=Slider(0, range=0..1000000),
    SpillToHost=True,
    DefaultVectorFormat="V3F",
    DefaultScalarFormat="F32",
    Backend="CudaOnly",
    rhinomcp_alias="settings",
    rhinomcp_graph_id="MCPGraph_20261017161257180")  # -> SessionInfo, SessionID
upmsh = UploadMesh(Mesh=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, Format="V3F")
panel = Panel(gpusettings.SessionInfo)

# ----
mverts = MeshVerticesGPU(Mesh=upmsh)
clspt = ClosestPointGPU(Queries=mverts, Targets=uppts)  # -> Points, Indices, Distances
v2pt = Vector2PtGPU(PointA=mverts, PointB=clspt.Points, Unitize=False)  # -> Vector, Length
bnd = BoundsGPU(Numbers=clspt.Distances)
remap = RemapNumbersGPU(Values=clspt.Distances, SourceBounds=bnd, TargetMin=0, TargetMax=1)
ramp = ColourRampGPU(Scalars=remap, LowColour=RGB(0, 0, 255), HighColour=RGB(255, 0, 0))
amp = AmplitudeGPU(Vector=v2pt.Vector, Amplitude=remap)
mdisp = MeshDisplaceGPU(Mesh=upmsh, Vectors=amp)
mcol = MeshColoursGPU(Mesh=mdisp, Colours=ramp)
down = DownloadGPU(Mesh=mcol)  # -> Points, Vectors, Numbers, Indices, Colours, Meshes

# ---- group: Memory configuration: 256 MB budget, 64 MB pool, compact V3F/F32 storage (continued)
gpudiag = GPUPreviewDiagnostics(Geometry=mcol, EnablePreview=True)  # -> Diagnostics, ActiveBytes, LiveAllocations, DeviceName
panel_2 = Panel(gpudiag.Diagnostics)
