# Grasshopper definition GhostGPU-MeshBooleans.gh (Grasshopper 1.0.8)
# plug-ins: GhostGPU

# ---- group: Inputs: mesh box + mesh sphere / GhostGPU mesh booleans (GPU broadphase, tri-tri, winding classification) / Native mesh booleans (reference)
number_slider = Slider(10, range=1..30)
number_slider_2 = Slider(6, range=-15..15)
number_slider_3 = Slider(24, range=4..128)
box = CenterBox(
    Base=PlaneXY(0, 0, 0),
    X=number_slider,
    Y=number_slider,
    Z=number_slider,
    rhinomcp_alias="cbox",
    rhinomcp_graph_id="MCPGraph_20261017161129839")
pt = ConstructPoint(
    XCoordinate=number_slider_2,
    YCoordinate=number_slider_2,
    ZCoordinate=0,
    rhinomcp_alias="pt",
    rhinomcp_graph_id="MCPGraph_20261017161129839")
msphere = MeshSphere(
    Base=pt,
    Radius=Slider(7, range=0.5..20),
    UCount=number_slider_3,
    VCount=number_slider_3,
    rhinomcp_alias="msph",
    rhinomcp_graph_id="MCPGraph_20261017161129839")
mesh = MeshBrep(
    Brep=box,
    Settings={GridMaxCount=0, GridMinCount=16, JaggedSeams=False, MaxEdgeLength=0, MinEdgeLength=0.0001, MinTolerance=0, Refine=True, RefineAngle=0, RelativeTolerance=0.65, SimplePlanes=True, Tolerance=0},
    rhinomcp_alias="mbox",
    rhinomcp_graph_id="MCPGraph_20261017161129839")
merge = Merge(Data1=mesh, Data2=msphere, rhinomcp_alias="mlist", rhinomcp_graph_id="MCPGraph_20261017161129839")
gmdiff = MeshDifferenceGPU(MeshesA=mesh, MeshesB=msphere, rhinomcp_alias="gdiff", rhinomcp_graph_id="MCPGraph_20261017161129839")
gmint = MeshIntersectionGPU(MeshesA=mesh, MeshesB=msphere, rhinomcp_alias="gint", rhinomcp_graph_id="MCPGraph_20261017161129839")
mdif = MeshDifference(MeshesA=mesh, MeshesB=msphere, rhinomcp_alias="ndiff", rhinomcp_graph_id="MCPGraph_20261017161129839")
mint = MeshIntersection(MeshesA=mesh, MeshesB=msphere, rhinomcp_alias="nint", rhinomcp_graph_id="MCPGraph_20261017161129839")
gmunion = MeshUnionGPU(Meshes=merge, rhinomcp_alias="gunion", rhinomcp_graph_id="MCPGraph_20261017161129839")
munion = MeshUnion(Meshes=merge, rhinomcp_alias="nunion", rhinomcp_graph_id="MCPGraph_20261017161129839")
volume = Volume(Geometry=gmdiff, rhinomcp_alias="V_gd", rhinomcp_graph_id="MCPGraph_20261017161129839")  # -> Volume, Centroid
volume_2 = Volume(Geometry=mdif, rhinomcp_alias="V_nd", rhinomcp_graph_id="MCPGraph_20261017161129839")  # -> Volume, Centroid
volume_3 = Volume(Geometry=gmint, rhinomcp_alias="V_gi", rhinomcp_graph_id="MCPGraph_20261017161129839")  # -> Volume, Centroid
volume_4 = Volume(Geometry=mint, rhinomcp_alias="V_ni", rhinomcp_graph_id="MCPGraph_20261017161129839")  # -> Volume, Centroid
volume_5 = Volume(Geometry=gmunion, rhinomcp_alias="V_gu", rhinomcp_graph_id="MCPGraph_20261017161129839")  # -> Volume, Centroid
volume_6 = Volume(Geometry=munion, rhinomcp_alias="V_nu", rhinomcp_graph_id="MCPGraph_20261017161129839")  # -> Volume, Centroid
