# Grasshopper definition GhostGPU-Phase1.gh (Grasshopper 1.0.8)

X = Number(Tree({0;2}: [1, 2, 3], {1;3}: [4, 5]))
Y = Number(Tree({0;2}: [1], {1;3}: [2]))
Z = Number(Tree({0;2}: [0], {1;3}: [0]))
quad_mesh = Mesh(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)
origin = Point(Point(0, 0, 0))
scale = Number(2)
upnum = UploadNumbers(Numbers=X)
upnum_2 = UploadNumbers(Numbers=Y)
upnum_3 = UploadNumbers(Numbers=Z)
vec = ConstructVectorGPU(X=upnum, Y=upnum_2, Z=upnum_3)
vlen = VectorLengthGPU(Vectors=vec)
down = DownloadGPU(Buffer=vlen)  # -> Points, Vectors, Numbers, Indices, Colours, Meshes
vec_2 = VectorXYZ(XComponent=X, YComponent=Y, ZComponent=Z)  # -> Vector, Length
vlen_2 = VectorLength(Vector=vec_2.Vector)
upmsh = UploadMesh(Mesh=quad_mesh)
uppts = UploadPoints(Points=origin)
upnum_4 = UploadNumbers(Numbers=scale)
mscale = MeshScaleGPU(Mesh=upmsh, Center=uppts, Factor=upnum_4)
fnorm = FaceNormalsGPU(Mesh=mscale)  # -> Centers, Normals
farea = FaceAreasGPU(Mesh=mscale)
down_2 = DownloadGPU(Mesh=mscale)  # -> Points, Vectors, Numbers, Indices, Colours, Meshes
down_3 = DownloadGPU(Buffer=farea)  # -> Points, Vectors, Numbers, Indices, Colours, Meshes
demesh = DeconstructMeshGPU(Mesh=mscale)  # -> Vertices, Faces, Colours, Normals
