# Grasshopper definition GhostGPU-Showcase-Clusters.gh (Grasshopper 1.0.8)
# plug-ins: GhostGPU

# ---- group: 1 Shared inputs (built once, identical for both clusters)
profile_pts = Panel("""0,0,0
8,0,0
10,0,8
8,0,16
6,0,20
0,0,20""")
count_n_1 = Slider(3, range=1..24)
twist_rad = Slider(4, range=0..12.566)
cyl_radius = Slider(1.2, range=0.3..3)
sphere_radius = Slider(2, range=0.5..4)
sphere_ring_r = Slider(9, range=5..12)
mesh_max_edge = Slider(1.5, range=0.25..5)
attractor_count = Slider(2, range=1..10)
attractor_seed = Slider(3, range=0..100)
amp = Slider(-1.5, range=-4..4)
custom_mesh_settings = SettingsCustom(
    StitchSeams=True,
    SimplePlanes=False,
    Refine=True,
    MinCount=16,
    MaxCount=400,
    AspectRatio=20,
    MaxDistance=0,
    MaxAngle=20,
    MinEdge=0,
    MaxEdge=mesh_max_edge,
    rhinomcp_alias="ms",
    rhinomcp_graph_id="shared")
range = Range(Domain="3 To 17", Steps=count_n_1, rhinomcp_alias="rz", rhinomcp_graph_id="shared")
# Read me: GhostGPU vs native - two clusters, identical inputs and outputs
# Shared inputs (left): profile revolved+capped = Vessel; N+1 capped through-cylinders (Pipe, flat caps) and N+1 spheres on a twisted spiral; all meshed once with Mesh Brep (Mesh max edge); attractors = Populate 3D (count, seed) in a 30x30x20 box; Amp. Cylinders are flattened so each boolean uses all cutters at once.
# Cluster 'GhostGPU Showcase' (GhostGPU nodes): Solid Difference/Union/Intersection GPU (Kernel input: GhostGPU | RhinoCommon; a GhostGPU-kernel pair that fails falls back to RhinoCommon split/join with a warning inside the cluster), Mesh Difference/Union/Intersection GPU, and the GPU-resident field: Upload Mesh -> Mesh Vertices -> Closest Point -> Bounds -> Remap (near=1, far=0) -> Function Map SmoothStep -> x Amp -> Amplitude(Vector 2Pt) -> Mesh Displace + Colour Ramp -> Mesh Colours -> Download.
# Cluster 'Native Showcase' (official GH nodes only): Solid Difference/Union/Intersection, Mesh Difference/Union/Intersection, field = Deconstruct Mesh -> Closest Point -> Bounds -> Remap Numbers -> Expression smoothstep t*t*(3-2t) with t clamped to [0,1] -> x Amp -> Amplitude(Vector 2Pt) -> Move vertices -> Construct Mesh -> Gradient (blue->red, linear) -> Mesh Colours.
# Both fields act on each cluster's own Mesh Difference result, so the two field meshes can have different topology; deviation is measured by closest point (Pull Point) both ways.
# Outputs: Diff, Union, Int (Breps), MDiff, MUnion, MInt (meshes), Field (displaced, coloured mesh).
# Session Settings + Diagnostics stay outside the clusters. Note: GhostGPU keeps one GPU session per GH_Document and a cluster solves in its own inner document, so these settings/diagnostics describe the outer document session, not the session used inside the cluster.
# Viewport: row y=0 = GhostGPU cluster, row y=-40 = Native cluster; columns x=0..180: Diff, Union, Int, MDiff, MUnion, MInt, Field.
pline = PolyLine(Vertices=profile_pts, Closed=False, rhinomcp_alias="pl", rhinomcp_graph_id="shared")
ln = Line(StartPoint="0,0,0", EndPoint="0,0,20", rhinomcp_alias="axl", rhinomcp_graph_id="shared")
dom = ConstructDomain(DomainStart=0, DomainEnd=twist_rad, rhinomcp_alias="dom", rhinomcp_graph_id="shared")
box = CenterBox(Base="0,0,10", X=15, Y=15, Z=10, rhinomcp_alias="box", rhinomcp_graph_id="shared")
revsrf = Revolution(Curve=pline, Axis=ln, Domain=Domain(0, 6.283185307), rhinomcp_alias="rev", rhinomcp_graph_id="shared")
range_2 = Range(Domain=dom, Steps=count_n_1, rhinomcp_alias="ra", rhinomcp_graph_id="shared")
attractors = Populate3D(Region=box, Count=attractor_count, Seed=attractor_seed, rhinomcp_alias="pop", rhinomcp_graph_id="shared")
pt = ConstructPoint(XCoordinate=12, YCoordinate=0, ZCoordinate=range, rhinomcp_alias="p1", rhinomcp_graph_id="shared")
pt_2 = ConstructPoint(XCoordinate=-12, YCoordinate=0, ZCoordinate=range, rhinomcp_alias="p2", rhinomcp_graph_id="shared")
pt_3 = ConstructPoint(XCoordinate=0, YCoordinate=sphere_ring_r, ZCoordinate=range, rhinomcp_alias="p3", rhinomcp_graph_id="shared")
rotate = Rotate(Geometry=pt_3, Angle=range_2, Plane=PlaneXY(0, 0, 0), rhinomcp_alias="rot2", rhinomcp_graph_id="shared")  # -> Geometry, Transform
ln_2 = Line(StartPoint=pt, EndPoint=pt_2, rhinomcp_alias="cl", rhinomcp_graph_id="shared")
vessel = CapHoles(Brep=revsrf, rhinomcp_alias="cap", rhinomcp_graph_id="shared")
rotate_2 = Rotate(Geometry=ln_2, Angle=range_2, Plane=PlaneXY(0, 0, 0), rhinomcp_alias="rot1", rhinomcp_graph_id="shared")  # -> Geometry, Transform
spheres = Sphere(Base=rotate.Geometry, Radius=sphere_radius, rhinomcp_alias="sph", rhinomcp_graph_id="shared")
vessel_mesh = MeshBrep(Brep=vessel, Settings=custom_mesh_settings, rhinomcp_alias="mv", rhinomcp_graph_id="shared")
cylinders = Pipe(Curve=rotate_2.Geometry, Radius=cyl_radius, Caps=1, FitRail=False, rhinomcp_alias="pipe", rhinomcp_graph_id="shared")  # -> flatten(Pipe)
sphere_meshes = MeshBrep(Brep=spheres, Settings=custom_mesh_settings, rhinomcp_alias="msp", rhinomcp_graph_id="shared")
cyl_meshes = MeshBrep(Brep=cylinders, Settings=custom_mesh_settings, rhinomcp_alias="mc", rhinomcp_graph_id="shared")  # -> flatten(Mesh)

# ---- group: 2 Clusters: GhostGPU Showcase (top; Kernel panel feeds only it) | Native Showcase (bottom)
kernel = Panel("GhostGPU")
# Cluster timings: CLUSTER TIMINGS (GH_Component.ProcessorTime of each cluster object, read by reflection after a warm recompute = 2nd full solve; N=3, Mesh max edge 1.5, 2 attractors)
# Kernel=GhostGPU:    GhostGPU Showcase 5069 ms | Native Showcase 831 ms
#    inner: Diff GPU 3524, Union GPU 831, Int GPU 501, MDiff GPU 112, MUnion GPU 26, MInt GPU 72, field chain ~3 ms total
#    inner: Diff 89, Union 51, Int 34, MDiff 292, MUnion 84, MInt 97, field chain ~165 ms (SmoothStep Expression 128)
# Kernel=RhinoCommon: GhostGPU Showcase 4214 ms | Native Showcase 1036 ms
#    inner: Diff GPU 2730, Union GPU 640, Int GPU 545, MDiff GPU 132, MUnion GPU 31, MInt GPU 131
# With Kernel=GhostGPU every Solid op logs 'GhostGPU kernel ... failed ... falling back to the RhinoCommon split/join path' for some pairs (see the GPU nodes inside the cluster).
# Static text: re-measure after changing sliders.
ghostgpu_showcase = GhostGPUShowcase(
    vessel=vessel,
    cylinders=cylinders,
    spheres=spheres,
    vessel_mesh=vessel_mesh,
    cyl_meshes=cyl_meshes,
    sphere_meshes=sphere_meshes,
    attractors=attractors,
    amp=amp,
    kernel=kernel)  # -> diff_2, union_2, int_2, mdiff_2, munion_2, mint_2, field_2
native_showcase = NativeShowcase(
    vessel=vessel,
    cylinders=cylinders,
    spheres=spheres,
    vessel_mesh=vessel_mesh,
    cyl_meshes=cyl_meshes,
    sphere_meshes=sphere_meshes,
    attractors=attractors,
    amp=amp)  # -> diff_2, union_2, int_2, mdiff_2, munion_2, mint_2, field_2

# ---- group: 5 Memory: GPU Session Settings + Diagnostics (outer-document session)
memmb = Slider(512, range=128..4096)
poolmb = Slider(128, range=0..1024)
hostthresh = Slider(65536, range=0..65536)
vecfmt = Panel("V3D")
gpusettings = GPUSessionSettings(
    MemoryLimitMB=memmb,
    PoolCacheMB=poolmb,
    StagingSlots=4,
    StagingSlotMB=16,
    HostThreshold=hostthresh,
    SpillToHost=True,
    DefaultVectorFormat=vecfmt,
    DefaultScalarFormat="F64",
    Backend="CudaOnly",
    rhinomcp_alias="gset",
    rhinomcp_graph_id="mem")  # -> SessionInfo, SessionID
gpudiag = GPUPreviewDiagnostics(Geometry=ghostgpu_showcase.field_2, EnablePreview=False, rhinomcp_alias="gdiag", rhinomcp_graph_id="mem")  # -> Diagnostics, ActiveBytes, LiveAllocations, DeviceName
session_info = Panel(gpusettings.SessionInfo)
diagnostics = Panel(gpudiag.Diagnostics)

# ---- group: 3 Comparison: per-op volume, count, GPU-native; field deviation
gpu_breps = Entwine(
    Branch00=flatten(ghostgpu_showcase.diff_2),
    Branch01=flatten(ghostgpu_showcase.union_2),
    Branch02=flatten(ghostgpu_showcase.int_2),
    FlattenInputs=True,
    rhinomcp_alias="eBG",
    rhinomcp_graph_id="cmp")
native_breps = Entwine(
    Branch00=flatten(native_showcase.diff_2),
    Branch01=flatten(native_showcase.union_2),
    Branch02=flatten(native_showcase.int_2),
    FlattenInputs=True,
    rhinomcp_alias="eBN",
    rhinomcp_graph_id="cmp")
gpu_meshes = Entwine(
    Branch00=flatten(ghostgpu_showcase.mdiff_2),
    Branch01=flatten(ghostgpu_showcase.munion_2),
    Branch02=flatten(ghostgpu_showcase.mint_2),
    FlattenInputs=True,
    rhinomcp_alias="eMG",
    rhinomcp_graph_id="cmp")
native_meshes = Entwine(
    Branch00=flatten(native_showcase.mdiff_2),
    Branch01=flatten(native_showcase.munion_2),
    Branch02=flatten(native_showcase.mint_2),
    FlattenInputs=True,
    rhinomcp_alias="eMN",
    rhinomcp_graph_id="cmp")
demesh = DeconstructMesh(Mesh=ghostgpu_showcase.field_2, rhinomcp_alias="dGF", rhinomcp_graph_id="cmp")  # -> Vertices, Faces, Colours, Normals
demesh_2 = DeconstructMesh(Mesh=native_showcase.field_2, rhinomcp_alias="dNF", rhinomcp_graph_id="cmp")  # -> Vertices, Faces, Colours, Normals
volume = Volume(Geometry=gpu_meshes, rhinomcp_alias="vMG", rhinomcp_graph_id="cmp")  # -> Volume, Centroid
volume_2 = Volume(Geometry=native_meshes, rhinomcp_alias="vMN", rhinomcp_graph_id="cmp")  # -> Volume, Centroid
pull = PullPoint(Point=demesh.Vertices, Geometry=native_showcase.field_2, ClosestOnly=True, rhinomcp_alias="ppG", rhinomcp_graph_id="cmp")  # -> ClosestPoint, Distance, Index
pull_2 = PullPoint(
    Point=demesh_2.Vertices,
    Geometry=ghostgpu_showcase.field_2,
    ClosestOnly=True,
    rhinomcp_alias="ppN",
    rhinomcp_graph_id="cmp")  # -> ClosestPoint, Distance, Index
volume_3 = BrepVolume(Brep=gpu_breps, rhinomcp_alias="vBG", rhinomcp_graph_id="cmp")  # -> Volume, Centroid
volume_4 = BrepVolume(Brep=native_breps, rhinomcp_alias="vBN", rhinomcp_graph_id="cmp")  # -> Volume, Centroid
lng = ListLength(List=gpu_breps, rhinomcp_alias="lBG", rhinomcp_graph_id="cmp")
lng_2 = ListLength(List=native_breps, rhinomcp_alias="lBN", rhinomcp_graph_id="cmp")
lng_3 = ListLength(List=gpu_meshes, rhinomcp_alias="lMG", rhinomcp_graph_id="cmp")
lng_4 = ListLength(List=native_meshes, rhinomcp_alias="lMN", rhinomcp_graph_id="cmp")
bnd = Bounds(Numbers=pull.Distance, rhinomcp_alias="bG", rhinomcp_graph_id="cmp")
bnd_2 = Bounds(Numbers=pull_2.Distance, rhinomcp_alias="bN", rhinomcp_graph_id="cmp")
subtraction = Subtraction(A=lng, B=lng_2, rhinomcp_alias="sBC", rhinomcp_graph_id="cmp")
subtraction_2 = Subtraction(A=lng_3, B=lng_4, rhinomcp_alias="sMC", rhinomcp_graph_id="cmp")
ma = MassAddition(Input=volume_3.Volume, rhinomcp_alias="maBG", rhinomcp_graph_id="cmp")  # -> Result, PartialResults
ma_2 = MassAddition(Input=volume_4.Volume, rhinomcp_alias="maBN", rhinomcp_graph_id="cmp")  # -> Result, PartialResults
ma_3 = MassAddition(Input=volume.Volume, rhinomcp_alias="maMG", rhinomcp_graph_id="cmp")  # -> Result, PartialResults
ma_4 = MassAddition(Input=volume_2.Volume, rhinomcp_alias="maMN", rhinomcp_graph_id="cmp")  # -> Result, PartialResults
entwine = Entwine(
    Branch00=flatten(lng),
    Branch01=flatten(lng_2),
    Branch02=flatten(subtraction),
    FlattenInputs=True,
    rhinomcp_alias="tBC",
    rhinomcp_graph_id="cmp")
entwine_2 = Entwine(
    Branch00=flatten(lng_3),
    Branch01=flatten(lng_4),
    Branch02=flatten(subtraction_2),
    FlattenInputs=True,
    rhinomcp_alias="tMC",
    rhinomcp_graph_id="cmp")
merge = Merge(Data1=flatten(bnd), Data2=flatten(bnd_2), rhinomcp_alias="mDev", rhinomcp_graph_id="cmp")
subtraction_3 = Subtraction(A=ma.Result, B=ma_2.Result, rhinomcp_alias="sBV", rhinomcp_graph_id="cmp")
subtraction_4 = Subtraction(A=ma_3.Result, B=ma_4.Result, rhinomcp_alias="sMV", rhinomcp_graph_id="cmp")
entwine_3 = Entwine(
    Branch00=flatten(ma.Result),
    Branch01=flatten(ma_2.Result),
    Branch02=flatten(subtraction_3),
    FlattenInputs=True,
    rhinomcp_alias="tBV",
    rhinomcp_graph_id="cmp")
entwine_4 = Entwine(
    Branch00=flatten(ma_3.Result),
    Branch01=flatten(ma_4.Result),
    Branch02=flatten(subtraction_4),
    FlattenInputs=True,
    rhinomcp_alias="tMV",
    rhinomcp_graph_id="cmp")
brep_volume_diff_union_int_0_0_gpu_0_1_n = Panel(entwine_3)  # "Brep volume [Diff,Union,Int]: {0;0}=GPU {0;1}=native {0;2}=GPU-native"
brep_count_diff_union_int_0_0_gpu_0_1_na = Panel(entwine)  # "Brep count [Diff,Union,Int]: {0;0}=GPU {0;1}=native {0;2}=GPU-native"
mesh_volume_mdiff_munion_mint_0_0_gpu_0 = Panel(entwine_4)  # "Mesh volume [MDiff,MUnion,MInt]: {0;0}=GPU {0;1}=native {0;2}=GPU-native"
mesh_count_mdiff_munion_mint_0_0_gpu_0_1 = Panel(entwine_2)  # "Mesh count [MDiff,MUnion,MInt]: {0;0}=GPU {0;1}=native {0;2}=GPU-native"
field_max_vertex_deviation_pull_point_do = Panel(merge)  # "Field max vertex deviation (Pull Point domains): [0]=GPU field verts->native field, [1]=native verts->GPU field"

# ---- group: 4 Viewport: row y=0 GhostGPU cluster, row y=-40 Native cluster (only these preview)
series = Series(Start=0, Step=30, Count=3, rhinomcp_alias="srA", rhinomcp_graph_id="preview")
series_2 = Series(Start=90, Step=30, Count=3, rhinomcp_alias="srB", rhinomcp_graph_id="preview")
series_3 = Series(Start=-10, Step=30, Count=8, rhinomcp_alias="srL", rhinomcp_graph_id="preview")
vec = VectorXYZ(XComponent=180, YComponent=0, ZComponent=0, rhinomcp_alias="vG3", rhinomcp_graph_id="preview")  # -> Vector, Length
vec_2 = VectorXYZ(XComponent=180, YComponent=-40, ZComponent=0, rhinomcp_alias="vN3", rhinomcp_graph_id="preview")  # -> Vector, Length
gpu_labels = Panel("""Diff
Union
Int
MDiff
MUnion
MInt
Field
<- GhostGPU Showcase cluster""")
native_labels = Panel("""Diff
Union
Int
MDiff
MUnion
MInt
Field
<- Native Showcase cluster""")
show_gpu_field = Move(Geometry=ghostgpu_showcase.field_2, Motion=vec.Vector, rhinomcp_alias="mvGF", rhinomcp_graph_id="preview")  # -> Geometry, Transform
show_native_field = Move(Geometry=native_showcase.field_2, Motion=vec_2.Vector, rhinomcp_alias="mvNF", rhinomcp_graph_id="preview")  # -> Geometry, Transform
vec_3 = VectorXYZ(XComponent=series, YComponent=0, ZComponent=0, rhinomcp_alias="vG1", rhinomcp_graph_id="preview")  # -> Vector, Length
vec_4 = VectorXYZ(XComponent=series_2, YComponent=0, ZComponent=0, rhinomcp_alias="vG2", rhinomcp_graph_id="preview")  # -> Vector, Length
vec_5 = VectorXYZ(XComponent=series, YComponent=-40, ZComponent=0, rhinomcp_alias="vN1", rhinomcp_graph_id="preview")  # -> Vector, Length
vec_6 = VectorXYZ(XComponent=series_2, YComponent=-40, ZComponent=0, rhinomcp_alias="vN2", rhinomcp_graph_id="preview")  # -> Vector, Length
pt_4 = ConstructPoint(XCoordinate=series_3, YCoordinate=-15, ZCoordinate=0, rhinomcp_alias="ptG", rhinomcp_graph_id="preview")
pt_5 = ConstructPoint(XCoordinate=series_3, YCoordinate=-55, ZCoordinate=0, rhinomcp_alias="ptN", rhinomcp_graph_id="preview")
show_gpu_breps = Move(Geometry=gpu_breps, Motion=graft(vec_3.Vector), rhinomcp_alias="mvGB", rhinomcp_graph_id="preview")  # -> Geometry, Transform
show_gpu_meshes = Move(Geometry=gpu_meshes, Motion=graft(vec_4.Vector), rhinomcp_alias="mvGM", rhinomcp_graph_id="preview")  # -> Geometry, Transform
show_native_breps = Move(Geometry=native_breps, Motion=graft(vec_5.Vector), rhinomcp_alias="mvNB", rhinomcp_graph_id="preview")  # -> Geometry, Transform
show_native_meshes = Move(Geometry=native_meshes, Motion=graft(vec_6.Vector), rhinomcp_alias="mvNM", rhinomcp_graph_id="preview")  # -> Geometry, Transform
gpu_row_labels = TextTag3D(Location=pt_4, Text=gpu_labels, Size=2.5, Justification=7, rhinomcp_alias="tagG", rhinomcp_graph_id="preview")
native_row_labels = TextTag3D(Location=pt_5, Text=native_labels, Size=2.5, Justification=7, rhinomcp_alias="tagN", rhinomcp_graph_id="preview")

# ==== cluster GhostGPUShowcase: GhostGPU nodes only: Solid Diff/Union/Int GPU (Kernel), Mesh Diff/Union/Int GPU, GPU-resident attractor field.
sphere_meshes = ClusterInput()
vessel_mesh = ClusterInput()
cyl_meshes = ClusterInput()
attractors = ClusterInput()
cylinders = ClusterInput()
spheres = ClusterInput()
vessel = ClusterInput()
amp = ClusterInput()
kernel = ClusterInput()
sphere_meshes_2 = Mesh(flatten(sphere_meshes), rhinomcp_alias="gSM", rhinomcp_graph_id="gpu")
vessel_mesh_2 = Mesh(flatten(vessel_mesh), rhinomcp_alias="gVM", rhinomcp_graph_id="gpu")
cyl_meshes_2 = Mesh(flatten(cyl_meshes), rhinomcp_alias="gCM", rhinomcp_graph_id="gpu")
attractors_2 = Point(flatten(attractors), rhinomcp_alias="gA", rhinomcp_graph_id="gpu")
cylinders_2 = Brep(flatten(cylinders), rhinomcp_alias="gC", rhinomcp_graph_id="gpu")
spheres_2 = Brep(flatten(spheres), rhinomcp_alias="gS", rhinomcp_graph_id="gpu")
vessel_2 = Brep(flatten(vessel), rhinomcp_alias="gV", rhinomcp_graph_id="gpu")
amp_2 = Number(amp, rhinomcp_alias="gAmp", rhinomcp_graph_id="gpu")
kernel_2 = Text(kernel, rhinomcp_alias="gK", rhinomcp_graph_id="gpu")
uppts = UploadPoints(Points=attractors_2, rhinomcp_alias="upP", rhinomcp_graph_id="gpu")
upnum = UploadNumbers(Numbers=amp_2, rhinomcp_alias="upN", rhinomcp_graph_id="gpu")
merge = Merge(Data1=cylinders_2, Data2=spheres_2, rhinomcp_alias="gM1", rhinomcp_graph_id="gpu")
merge_2 = Merge(Data1=vessel_2, Data2=spheres_2, rhinomcp_alias="gM2", rhinomcp_graph_id="gpu")
merge_3 = Merge(Data1=cyl_meshes_2, Data2=sphere_meshes_2, rhinomcp_alias="gM3", rhinomcp_graph_id="gpu")
merge_4 = Merge(Data1=vessel_mesh_2, Data2=sphere_meshes_2, rhinomcp_alias="gM4", rhinomcp_graph_id="gpu")
munion_gpu = MeshUnionGPU(Meshes=merge_4, rhinomcp_alias="gMU", rhinomcp_graph_id="gpu")
diff_gpu = SolidDifferenceGPU(BrepsA=vessel_2, BrepsB=merge, Kernel=kernel_2, rhinomcp_alias="gDiff", rhinomcp_graph_id="gpu")
int_gpu = SolidIntersectionGPU(BrepsA=vessel_2, BrepsB=cylinders_2, Kernel=kernel_2, rhinomcp_alias="gInt", rhinomcp_graph_id="gpu")
mdiff_gpu = MeshDifferenceGPU(MeshesA=vessel_mesh_2, MeshesB=merge_3, rhinomcp_alias="gMD", rhinomcp_graph_id="gpu")
upmsh = UploadMesh(Mesh=mdiff_gpu, rhinomcp_alias="up", rhinomcp_graph_id="gpu")
mint_gpu = MeshIntersectionGPU(MeshesA=vessel_mesh_2, MeshesB=cyl_meshes_2, rhinomcp_alias="gMI", rhinomcp_graph_id="gpu")
union_gpu = SolidUnionGPU(Breps=merge_2, Kernel=kernel_2, rhinomcp_alias="gUni", rhinomcp_graph_id="gpu")
mverts = MeshVerticesGPU(Mesh=upmsh, rhinomcp_alias="mvt", rhinomcp_graph_id="gpu")
clspt = ClosestPointGPU(Queries=mverts, Targets=uppts, rhinomcp_alias="cp", rhinomcp_graph_id="gpu")  # -> Points, Indices, Distances
bnd = BoundsGPU(Numbers=clspt.Distances, rhinomcp_alias="bnd", rhinomcp_graph_id="gpu")
remap = RemapNumbersGPU(Values=clspt.Distances, SourceBounds=bnd, TargetMin=1, TargetMax=0, rhinomcp_alias="rm", rhinomcp_graph_id="gpu")
map = FunctionMapGPU(Values=remap, Function=1, rhinomcp_alias="map", rhinomcp_graph_id="gpu")
math = ScalarMathGPU(BufferA=map, BufferB=upnum, Operation=2, rhinomcp_alias="mth", rhinomcp_graph_id="gpu")
ramp = ColourRampGPU(Scalars=map, LowColour=RGB(0, 0, 255), HighColour=RGB(255, 0, 0), rhinomcp_alias="ramp", rhinomcp_graph_id="gpu")
v2pt = Vector2PtGPU(PointA=mverts, PointB=clspt.Points, Unitize=False, rhinomcp_alias="v2", rhinomcp_graph_id="gpu")  # -> Vector, Length
amp_3 = AmplitudeGPU(Vector=v2pt.Vector, Amplitude=math, rhinomcp_alias="amp", rhinomcp_graph_id="gpu")
mdisp = MeshDisplaceGPU(Mesh=upmsh, Vectors=amp_3, rhinomcp_alias="disp", rhinomcp_graph_id="gpu")
mcol = MeshColoursGPU(Mesh=mdisp, Colours=ramp, rhinomcp_alias="mcol", rhinomcp_graph_id="gpu")
down = DownloadGPU(Mesh=mcol, rhinomcp_alias="down", rhinomcp_graph_id="gpu")  # -> Points, Vectors, Numbers, Indices, Colours, Meshes
munion = Mesh(munion_gpu, rhinomcp_alias="oMU", rhinomcp_graph_id="gpu")
diff = Brep(diff_gpu, rhinomcp_alias="oDiff", rhinomcp_graph_id="gpu")
union = Brep(union_gpu, rhinomcp_alias="oUni", rhinomcp_graph_id="gpu")
int = Brep(int_gpu, rhinomcp_alias="oInt", rhinomcp_graph_id="gpu")
mdiff = Mesh(mdiff_gpu, rhinomcp_alias="oMD", rhinomcp_graph_id="gpu")
mint = Mesh(mint_gpu, rhinomcp_alias="oMI", rhinomcp_graph_id="gpu")
field = Mesh(down.Meshes, rhinomcp_alias="oF", rhinomcp_graph_id="gpu")
diff_2 = ClusterOutput(diff)
union_2 = ClusterOutput(union)
int_2 = ClusterOutput(int)
mdiff_2 = ClusterOutput(mdiff)
munion_2 = ClusterOutput(munion)
mint_2 = ClusterOutput(mint)
field_2 = ClusterOutput(field)

# ==== cluster NativeShowcase: Official Grasshopper nodes only: Solid/Mesh Difference/Union/Intersection + native attractor field.
sphere_meshes = ClusterInput()
vessel_mesh = ClusterInput()
cyl_meshes = ClusterInput()
attractors = ClusterInput()
cylinders = ClusterInput()
spheres = ClusterInput()
vessel = ClusterInput()
amp = ClusterInput()
sphere_meshes_2 = Mesh(flatten(sphere_meshes), rhinomcp_alias="nSM", rhinomcp_graph_id="native")
vessel_mesh_2 = Mesh(flatten(vessel_mesh), rhinomcp_alias="nVM", rhinomcp_graph_id="native")
cyl_meshes_2 = Mesh(flatten(cyl_meshes), rhinomcp_alias="nCM", rhinomcp_graph_id="native")
attractors_2 = Point(flatten(attractors), rhinomcp_alias="nA", rhinomcp_graph_id="native")
cylinders_2 = Brep(flatten(cylinders), rhinomcp_alias="nC", rhinomcp_graph_id="native")
spheres_2 = Brep(flatten(spheres), rhinomcp_alias="nS", rhinomcp_graph_id="native")
vessel_2 = Brep(flatten(vessel), rhinomcp_alias="nV", rhinomcp_graph_id="native")
amp_2 = Number(amp, rhinomcp_alias="nAmp", rhinomcp_graph_id="native")
merge = Merge(Data1=cylinders_2, Data2=spheres_2, rhinomcp_alias="nM1", rhinomcp_graph_id="native")
merge_2 = Merge(Data1=vessel_2, Data2=spheres_2, rhinomcp_alias="nM2", rhinomcp_graph_id="native")
merge_3 = Merge(Data1=cyl_meshes_2, Data2=sphere_meshes_2, rhinomcp_alias="nM3", rhinomcp_graph_id="native")
merge_4 = Merge(Data1=vessel_mesh_2, Data2=sphere_meshes_2, rhinomcp_alias="nM4", rhinomcp_graph_id="native")
dom = ConstructDomain(DomainStart=1, DomainEnd=0, rhinomcp_alias="ndom", rhinomcp_graph_id="native")
munion_native = MeshUnion(Meshes=merge_4, rhinomcp_alias="nMU", rhinomcp_graph_id="native")
diff_native = SolidDifference(BrepsA=vessel_2, BrepsB=merge, rhinomcp_alias="nDiff", rhinomcp_graph_id="native")
int_native = SolidIntersection(BrepsA=vessel_2, BrepsB=cylinders_2, rhinomcp_alias="nInt", rhinomcp_graph_id="native")
mdiff_native = MeshDifference(MeshesA=vessel_mesh_2, MeshesB=merge_3, rhinomcp_alias="nMD", rhinomcp_graph_id="native")
mint_native = MeshIntersection(MeshesA=vessel_mesh_2, MeshesB=cyl_meshes_2, rhinomcp_alias="nMI", rhinomcp_graph_id="native")
union_native = SolidUnion(Breps=merge_2, rhinomcp_alias="nUni", rhinomcp_graph_id="native")
demesh = DeconstructMesh(Mesh=mdiff_native, rhinomcp_alias="dm", rhinomcp_graph_id="native")  # -> Vertices, Faces, Colours, Normals
cp = ClosestPoint(Point=demesh.Vertices, Cloud=attractors_2, rhinomcp_alias="ncp", rhinomcp_graph_id="native")  # -> ClosestPoint, CPIndex, Distance
bnd = Bounds(Numbers=cp.Distance, rhinomcp_alias="nb", rhinomcp_graph_id="native")
remap = RemapNumbers(Value=cp.Distance, Source=bnd, Target=dom, rhinomcp_alias="nr", rhinomcp_graph_id="native")  # -> Mapped, Clipped
smoothstep = Expression(
    x=remap.Mapped,
    Expression="min(1,max(0,x))*min(1,max(0,x))*(3-2*min(1,max(0,x)))",
    rhinomcp_alias="nss",
    rhinomcp_graph_id="native")
vec2pt = Vector2Pt(PointA=demesh.Vertices, PointB=cp.ClosestPoint, Unitize=False, rhinomcp_alias="nv2", rhinomcp_graph_id="native")  # -> Vector, Length
multiplication = Multiplication(A=smoothstep, B=amp_2, rhinomcp_alias="nmul", rhinomcp_graph_id="native")
gradient = Gradient(
    LowerLimit=0,
    UpperLimit=1,
    Parameter=smoothstep,
    stops=[0: RGB(0, 0, 255), 1: RGB(255, 0, 0)],
    rhinomcp_alias="ngr",
    rhinomcp_graph_id="native")
amp_3 = Amplitude(Vector=vec2pt.Vector, Amplitude=multiplication, rhinomcp_alias="namp", rhinomcp_graph_id="native")
move = Move(Geometry=demesh.Vertices, Motion=amp_3, rhinomcp_alias="nmov", rhinomcp_graph_id="native")  # -> Geometry, Transform
conmesh = ConstructMesh(Vertices=move.Geometry, Faces=demesh.Faces, rhinomcp_alias="ncm", rhinomcp_graph_id="native")
mcol = MeshColours(Mesh=conmesh, Colours=gradient, rhinomcp_alias="nmc", rhinomcp_graph_id="native")
munion = Mesh(munion_native, rhinomcp_alias="xMU", rhinomcp_graph_id="native")
diff = Brep(diff_native, rhinomcp_alias="xDiff", rhinomcp_graph_id="native")
union = Brep(union_native, rhinomcp_alias="xUni", rhinomcp_graph_id="native")
int = Brep(int_native, rhinomcp_alias="xInt", rhinomcp_graph_id="native")
mdiff = Mesh(mdiff_native, rhinomcp_alias="xMD", rhinomcp_graph_id="native")
mint = Mesh(mint_native, rhinomcp_alias="xMI", rhinomcp_graph_id="native")
field = Mesh(mcol, rhinomcp_alias="xF", rhinomcp_graph_id="native")
diff_2 = ClusterOutput(diff)
union_2 = ClusterOutput(union)
int_2 = ClusterOutput(int)
mdiff_2 = ClusterOutput(mdiff)
munion_2 = ClusterOutput(munion)
mint_2 = ClusterOutput(mint)
field_2 = ClusterOutput(field)
