# Grasshopper definition GhostGPU-Showcase.gh (Grasshopper 1.0.8)
# plug-ins: GhostGPU

# ---- group: A1 Vessel + spiral cutters (sliders)
# GhostGPU showcase
# GhostGPU v0.2 (own Brep kernel + GPU mesh booleans + resident GPU field pipeline).
# A: perforated vessel - exact Brep booleans, 3 variants side by side: GhostGPU kernel | RhinoCommon kernel | native GH.
# B: same solids meshed - GPU mesh booleans vs native.
# C: attractor displacement + colour field, fully GPU-resident until Download.
# D: GPU session memory settings + diagnostics.
# A. VESSEL + CUTTERS
# Profile polyline (edit the point panel) revolved about Z and capped.
# Cutters: N+1 horizontal through-cylinders (Pipe with flat caps = capped cylinder) and N+1 spheres biting into the wall, on a twisted spiral (spheres offset 90 deg from the cylinders).
# Sliders: Count N, Twist (total rad), Cylinder radius, Sphere radius, Sphere ring radius.
profile_pts = Panel("""0,0,0
8,0,0
10,0,8
8,0,16
6,0,20
0,0,20""")
count_n_1 = Slider(3, range=1..24)
twist_rad = Slider(4, range=0..12.566)
cyl_radius = Slider(1.2, range=0.3..3)
sphere_radius = Slider(2, range=0.5..4)
sphere_ring_r = Slider(9, range=5..12)
range = Range(Domain="3 To 17", Steps=count_n_1, rhinomcp_alias="zRange", rhinomcp_graph_id="showcaseA")
pline = PolyLine(Vertices=profile_pts, Closed=False, rhinomcp_alias="pline", rhinomcp_graph_id="showcaseA")
ln = Line(StartPoint="0,0,0", EndPoint="0,0,20", rhinomcp_alias="axis", rhinomcp_graph_id="showcaseA")
dom = ConstructDomain(DomainStart=0, DomainEnd=twist_rad, rhinomcp_alias="twDom", rhinomcp_graph_id="showcaseA")
revsrf = Revolution(Curve=pline, Axis=ln, Domain=Domain(0, 6.283185307), rhinomcp_alias="rev", rhinomcp_graph_id="showcaseA")
range_2 = Range(Domain=dom, Steps=count_n_1, rhinomcp_alias="aRange", rhinomcp_graph_id="showcaseA")
pt = ConstructPoint(XCoordinate=12, YCoordinate=0, ZCoordinate=range, rhinomcp_alias="ptA", rhinomcp_graph_id="showcaseA")
pt_2 = ConstructPoint(XCoordinate=-12, YCoordinate=0, ZCoordinate=range, rhinomcp_alias="ptB", rhinomcp_graph_id="showcaseA")
pt_3 = ConstructPoint(XCoordinate=0, YCoordinate=sphere_ring_r, ZCoordinate=range, rhinomcp_alias="sphC", rhinomcp_graph_id="showcaseA")
rotate = Rotate(Geometry=pt_3, Angle=range_2, Plane=PlaneXY(0, 0, 0), rhinomcp_alias="rotSph", rhinomcp_graph_id="showcaseA")  # -> Geometry, Transform
ln_2 = Line(StartPoint=pt, EndPoint=pt_2, rhinomcp_alias="cutLine", rhinomcp_graph_id="showcaseA")
cap = CapHoles(Brep=revsrf, rhinomcp_alias="cap", rhinomcp_graph_id="showcaseA")  # -> flatten(Brep)
rotate_2 = Rotate(Geometry=ln_2, Angle=range_2, Plane=PlaneXY(0, 0, 0), rhinomcp_alias="rotLine", rhinomcp_graph_id="showcaseA")  # -> Geometry, Transform
sph = Sphere(Base=rotate.Geometry, Radius=sphere_radius, rhinomcp_alias="sph", rhinomcp_graph_id="showcaseA")  # -> flatten(Sphere)
pipe = Pipe(Curve=rotate_2.Geometry, Radius=cyl_radius, Caps=1, FitRail=False, rhinomcp_alias="pipe", rhinomcp_graph_id="showcaseA")  # -> flatten(Pipe)
merge = Merge(Data1=pipe, Data2=sph, rhinomcp_alias="cutters", rhinomcp_graph_id="showcaseA")
merge_2 = Merge(Data1=cap, Data2=sph, rhinomcp_alias="mU", rhinomcp_graph_id="showcaseA2")

# ---- group: B1 Meshing (resolution slider)
# B. MESH BOOLEANS - the same vessel and cutters meshed with Mesh Brep (Max Edge slider = resolution; smaller = denser).
# GPU nodes (Mesh Difference/Union/Intersection GPU) vs native Mesh Difference/Union/Intersection.
# Panels: {0;0} = GPU, {0;1} = native. Volume = summed mesh Volume; Count = pieces (GPU nodes output one mesh per connected piece; native may return one combined mesh).
mesh_max_edge = Slider(1.5, range=0.25..5)
custom_mesh_settings = SettingsCustom(
    StitchSeams=True,
    SimplePlanes=False,
    Refine=True,
    MinCount=16,
    MaxCount=400,
    AspectRatio=20,
    MaxDistance=0,
    MaxAngle=20,
    MinEdge=0,
    MaxEdge=mesh_max_edge,
    rhinomcp_alias="mset",
    rhinomcp_graph_id="showcaseB")
mesh = MeshBrep(Brep=cap, Settings=custom_mesh_settings, rhinomcp_alias="meshV", rhinomcp_graph_id="showcaseB")
mesh_2 = MeshBrep(Brep=pipe, Settings=custom_mesh_settings, rhinomcp_alias="meshC", rhinomcp_graph_id="showcaseB")
mesh_3 = MeshBrep(Brep=sph, Settings=custom_mesh_settings, rhinomcp_alias="meshS", rhinomcp_graph_id="showcaseB")
merge_3 = Merge(Data1=mesh_2, Data2=mesh_3, rhinomcp_alias="mCut", rhinomcp_graph_id="showcaseB")
merge_4 = Merge(Data1=mesh, Data2=mesh_3, rhinomcp_alias="mUop", rhinomcp_graph_id="showcaseB")

# ---- group: B2 Mesh booleans: GPU | native -> volume, piece count
munion_gpu = MeshUnionGPU(Meshes=merge_4, rhinomcp_alias="muG", rhinomcp_graph_id="showcaseB")
mdiff_gpu = MeshDifferenceGPU(MeshesA=mesh, MeshesB=merge_3, rhinomcp_alias="mdG", rhinomcp_graph_id="showcaseB")
mint_gpu = MeshIntersectionGPU(MeshesA=mesh, MeshesB=mesh_2, rhinomcp_alias="miG", rhinomcp_graph_id="showcaseB")
munion_native = MeshUnion(Meshes=merge_4, rhinomcp_alias="muN", rhinomcp_graph_id="showcaseB")
mdiff_native = MeshDifference(MeshesA=mesh, MeshesB=merge_3, rhinomcp_alias="mdN", rhinomcp_graph_id="showcaseB")
mint_native = MeshIntersection(MeshesA=mesh, MeshesB=mesh_2, rhinomcp_alias="miN", rhinomcp_graph_id="showcaseB")
entwine = Entwine(Branch00=mdiff_gpu, Branch01=mdiff_native, FlattenInputs=True, rhinomcp_alias="eMD", rhinomcp_graph_id="showcaseB")
entwine_2 = Entwine(Branch00=munion_gpu, Branch01=munion_native, FlattenInputs=True, rhinomcp_alias="eMU", rhinomcp_graph_id="showcaseB")
entwine_3 = Entwine(Branch00=mint_gpu, Branch01=mint_native, FlattenInputs=True, rhinomcp_alias="eMI", rhinomcp_graph_id="showcaseB")
volume = Volume(Geometry=entwine, rhinomcp_alias="vMD", rhinomcp_graph_id="showcaseB")  # -> Volume, Centroid
volume_2 = Volume(Geometry=entwine_2, rhinomcp_alias="vMU", rhinomcp_graph_id="showcaseB")  # -> Volume, Centroid
volume_3 = Volume(Geometry=entwine_3, rhinomcp_alias="vMI", rhinomcp_graph_id="showcaseB")  # -> Volume, Centroid
lng = ListLength(List=entwine, rhinomcp_alias="lMD", rhinomcp_graph_id="showcaseB")
lng_2 = ListLength(List=entwine_2, rhinomcp_alias="lMU", rhinomcp_graph_id="showcaseB")
lng_3 = ListLength(List=entwine_3, rhinomcp_alias="lMI", rhinomcp_graph_id="showcaseB")
ma = MassAddition(Input=volume.Volume, rhinomcp_alias="maMD", rhinomcp_graph_id="showcaseB")  # -> Result, PartialResults
ma_2 = MassAddition(Input=volume_2.Volume, rhinomcp_alias="maMU", rhinomcp_graph_id="showcaseB")  # -> Result, PartialResults
ma_3 = MassAddition(Input=volume_3.Volume, rhinomcp_alias="maMI", rhinomcp_graph_id="showcaseB")  # -> Result, PartialResults
mdiff_volumes_gpu_n = Panel(ma.Result)
munion_volumes_gpu_n = Panel(ma_2.Result)
mint_volumes_gpu_n = Panel(ma_3.Result)
mdiff_counts = Panel(lng)
munion_counts = Panel(lng_2)
mint_counts = Panel(lng_3)

# ---- group: C Attractor field - GPU resident pipeline
# C. ATTRACTOR FIELD ON THE GPU MESH-DIFFERENCE RESULT (GPU-resident from Upload to Download)
# Upload Mesh -> Mesh Vertices -> Closest Point (to uploaded attractors) -> distances -> Bounds -> Remap (near=1, far=0) -> Function Map (1 = SmoothStep)
# -> x Amp (Scalar Math multiply) -> Amplitude of Vector 2Pt (vertex -> nearest attractor) -> Mesh Displace.
# Same SmoothStep field -> Colour Ramp -> Mesh Colours -> Download (the only readback).
# Amp > 0 pulls the surface toward the attractors, Amp < 0 pushes it away.
attractors = Panel("""14,0,10
-9,-11,5""")
amp = Slider(-1.5, range=-4..4)
upmsh = UploadMesh(Mesh=mdiff_gpu, rhinomcp_alias="upM", rhinomcp_graph_id="showcaseC")
uppts = UploadPoints(Points=attractors, rhinomcp_alias="upP", rhinomcp_graph_id="showcaseC")
upnum = UploadNumbers(Numbers=amp, rhinomcp_alias="upN", rhinomcp_graph_id="showcaseC")
mverts = MeshVerticesGPU(Mesh=upmsh, rhinomcp_alias="mv", rhinomcp_graph_id="showcaseC")
clspt = ClosestPointGPU(Queries=mverts, Targets=uppts, rhinomcp_alias="cp", rhinomcp_graph_id="showcaseC")  # -> Points, Indices, Distances
bnd = BoundsGPU(Numbers=clspt.Distances, rhinomcp_alias="bnd", rhinomcp_graph_id="showcaseC")
remap = RemapNumbersGPU(
    Values=clspt.Distances,
    SourceBounds=bnd,
    TargetMin=1,
    TargetMax=0,
    rhinomcp_alias="remap",
    rhinomcp_graph_id="showcaseC")
map = FunctionMapGPU(Values=remap, Function=1, rhinomcp_alias="fmap", rhinomcp_graph_id="showcaseC")
math = ScalarMathGPU(BufferA=map, BufferB=upnum, Operation=2, rhinomcp_alias="mul", rhinomcp_graph_id="showcaseC")
v2pt = Vector2PtGPU(PointA=mverts, PointB=clspt.Points, Unitize=False, rhinomcp_alias="v2", rhinomcp_graph_id="showcaseC")  # -> Vector, Length
ramp = ColourRampGPU(Scalars=map, LowColour=RGB(0, 0, 255), HighColour=RGB(255, 0, 0), rhinomcp_alias="ramp", rhinomcp_graph_id="showcaseC")
amp_2 = AmplitudeGPU(Vector=v2pt.Vector, Amplitude=math, rhinomcp_alias="ampC", rhinomcp_graph_id="showcaseC")
mdisp = MeshDisplaceGPU(Mesh=upmsh, Vectors=amp_2, rhinomcp_alias="disp", rhinomcp_graph_id="showcaseC")
mcol = MeshColoursGPU(Mesh=mdisp, Colours=ramp, rhinomcp_alias="mcol", rhinomcp_graph_id="showcaseC")
down = DownloadGPU(Mesh=mcol, rhinomcp_alias="down", rhinomcp_graph_id="showcaseC")  # -> Points, Vectors, Numbers, Indices, Colours, Meshes

# ---- group: D Memory: session settings + diagnostics
# D. MEMORY / SESSION
# GPU Session Settings recreates the document GPU session with these options.
# MemMB = device memory budget; PoolMB = device pool cache (staging ring Slots/SlotMB left at defaults).
# HostThresh = element count below which a job runs on the CPU host: 0 forces every job onto the GPU; 65536 (default) keeps small jobs (e.g. this ~7k-vertex mesh) on the CPU, where launch/transfer overhead would dominate.
# VecFmt: V3D = double-precision xyz (exact); V3F = compact float32 offsets (half the memory, float precision).
# GPU Preview & Diagnostics (fed by the Section C GPU mesh, preview off) reports live/peak memory, pool hits, uploads/downloads, kernel vs host dispatches.
memmb = Slider(512, range=128..4096)
poolmb = Slider(128, range=0..1024)
hostthresh = Slider(65536, range=0..65536)
vecfmt = Panel("V3D")
gpusettings = GPUSessionSettings(
    MemoryLimitMB=memmb,
    PoolCacheMB=poolmb,
    StagingSlots=4,
    StagingSlotMB=16,
    HostThreshold=hostthresh,
    SpillToHost=True,
    DefaultVectorFormat=vecfmt,
    DefaultScalarFormat="F64",
    Backend="CudaOnly",
    rhinomcp_alias="sess",
    rhinomcp_graph_id="showcaseD")  # -> SessionInfo, SessionID
session_info = Panel(gpusettings.SessionInfo)
gpudiag = GPUPreviewDiagnostics(Geometry=mcol, EnablePreview=False, rhinomcp_alias="diag", rhinomcp_graph_id="showcaseD")  # -> Diagnostics, ActiveBytes, LiveAllocations, DeviceName
diagnostics = Panel(gpudiag.Diagnostics)

# ---- group: A2 Brep kernel choice
# A. EXACT BREP BOOLEANS - per op 3 variants: {0;0} Solid * GPU with Kernel=GhostGPU | {0;1} same op with Kernel=RhinoCommon | {0;2} native Grasshopper op.
# Difference: vessel - (cylinders + spheres). Union: vessel + spheres. Intersection: vessel & cylinders.
# Panels: total Brep Volume per variant and result count per variant. Volumes should agree to ~1e-6.
# A yellow/grey balloon on a GhostGPU-kernel node ('GhostGPU kernel ... failed ... falling back to the RhinoCommon split/join path') means that pair was computed by the RhinoCommon fallback, not the own kernel.
kernel_ghostgpu = Panel("GhostGPU")
kernel_rhinocommon = Panel("RhinoCommon")

# ---- group: A3 Solid Difference: GhostGPU | RhinoCommon | native -> volume, count
diff_ghostgpu = SolidDifferenceGPU(BrepsA=cap, BrepsB=merge, Kernel=kernel_ghostgpu, rhinomcp_alias="dG", rhinomcp_graph_id="showcaseA2")
diff_rhinocommon = SolidDifferenceGPU(BrepsA=cap, BrepsB=merge, Kernel=kernel_rhinocommon, rhinomcp_alias="dR", rhinomcp_graph_id="showcaseA2")
diff_native = SolidDifference(BrepsA=cap, BrepsB=merge, rhinomcp_alias="dN", rhinomcp_graph_id="showcaseA2")
entwine_4 = Entwine(
    Branch00=diff_ghostgpu,
    Branch01=diff_rhinocommon,
    Branch02=diff_native,
    FlattenInputs=True,
    rhinomcp_alias="eD",
    rhinomcp_graph_id="showcaseA2")
volume_4 = BrepVolume(Brep=entwine_4, rhinomcp_alias="vD", rhinomcp_graph_id="showcaseA2")  # -> Volume, Centroid
lng_4 = ListLength(List=entwine_4, rhinomcp_alias="lD", rhinomcp_graph_id="showcaseA2")
ma_4 = MassAddition(Input=volume_4.Volume, rhinomcp_alias="maD", rhinomcp_graph_id="showcaseA2")  # -> Result, PartialResults
diff_volumes_g_rc_n = Panel(ma_4.Result)
diff_counts = Panel(lng_4)

# ---- group: A5 Solid Intersection (vessel & cylinders)
int_ghostgpu = SolidIntersectionGPU(BrepsA=cap, BrepsB=pipe, Kernel=kernel_ghostgpu, rhinomcp_alias="iG", rhinomcp_graph_id="showcaseA2")
int_rhinocommon = SolidIntersectionGPU(BrepsA=cap, BrepsB=pipe, Kernel=kernel_rhinocommon, rhinomcp_alias="iR", rhinomcp_graph_id="showcaseA2")
int_native = SolidIntersection(BrepsA=cap, BrepsB=pipe, rhinomcp_alias="iN", rhinomcp_graph_id="showcaseA2")
entwine_5 = Entwine(
    Branch00=int_ghostgpu,
    Branch01=int_rhinocommon,
    Branch02=int_native,
    FlattenInputs=True,
    rhinomcp_alias="eI",
    rhinomcp_graph_id="showcaseA2")
volume_5 = BrepVolume(Brep=entwine_5, rhinomcp_alias="vI", rhinomcp_graph_id="showcaseA2")  # -> Volume, Centroid
lng_5 = ListLength(List=entwine_5, rhinomcp_alias="lI", rhinomcp_graph_id="showcaseA2")
ma_5 = MassAddition(Input=volume_5.Volume, rhinomcp_alias="maI", rhinomcp_graph_id="showcaseA2")  # -> Result, PartialResults
int_volumes_g_rc_n = Panel(ma_5.Result)
int_counts = Panel(lng_5)

# ---- group: A4 Solid Union (vessel + spheres)
union_ghostgpu = SolidUnionGPU(Breps=merge_2, Kernel=kernel_ghostgpu, rhinomcp_alias="uG", rhinomcp_graph_id="showcaseA2")
union_rhinocommon = SolidUnionGPU(Breps=merge_2, Kernel=kernel_rhinocommon, rhinomcp_alias="uR", rhinomcp_graph_id="showcaseA2")
union_native = SolidUnion(Breps=merge_2, rhinomcp_alias="uN", rhinomcp_graph_id="showcaseA2")
entwine_6 = Entwine(
    Branch00=union_ghostgpu,
    Branch01=union_rhinocommon,
    Branch02=union_native,
    FlattenInputs=True,
    rhinomcp_alias="eU",
    rhinomcp_graph_id="showcaseA2")
volume_6 = BrepVolume(Brep=entwine_6, rhinomcp_alias="vU", rhinomcp_graph_id="showcaseA2")  # -> Volume, Centroid
lng_6 = ListLength(List=entwine_6, rhinomcp_alias="lU", rhinomcp_graph_id="showcaseA2")
ma_6 = MassAddition(Input=volume_6.Volume, rhinomcp_alias="maU", rhinomcp_graph_id="showcaseA2")  # -> Result, PartialResults
union_volumes_g_rc_n = Panel(ma_6.Result)
union_counts = Panel(lng_6)

# ---- group: Viewport layout (previewed results)
# VIEWPORT LAYOUT (only these previews are on)
# Row 1 (y=0): Brep Solid Difference  |  x=0 GhostGPU kernel  |  x=30 RhinoCommon kernel  |  x=60 native
# Row 2 (y=-35): Mesh Difference  |  x=0 GPU  |  x=60 native
# Row 3 (y=-35, x=30): attractor-displaced + coloured GPU mesh (Download)
move_rc_30x = Move(Geometry=diff_rhinocommon, Motion=Vector(30, 0, 0), rhinomcp_alias="mvR", rhinomcp_graph_id="showcaseOut")  # -> Geometry, Transform
move_native_60x = Move(Geometry=diff_native, Motion=Vector(60, 0, 0), rhinomcp_alias="mvN", rhinomcp_graph_id="showcaseOut")  # -> Geometry, Transform
move_mesh_gpu = Move(Geometry=mdiff_gpu, Motion=Vector(0, -35, 0), rhinomcp_alias="mvMG", rhinomcp_graph_id="showcaseOut")  # -> Geometry, Transform
move_field = Move(Geometry=down.Meshes, Motion=Vector(30, -35, 0), rhinomcp_alias="mvF", rhinomcp_graph_id="showcaseOut")  # -> Geometry, Transform
move_mesh_native = Move(Geometry=mdiff_native, Motion=Vector(60, -35, 0), rhinomcp_alias="mvMN", rhinomcp_graph_id="showcaseOut")  # -> Geometry, Transform
