# Grasshopper definition GhostGPU-SolidBooleans.gh (Grasshopper 1.0.8)
# plug-ins: GhostGPU

# ---- group: Inputs: box, sphere, cylinder / GhostGPU hybrid booleans (GPU broadphase + winding classification) / Native Grasshopper booleans (reference) / GPU diagnostics
gpudiag = GPUPreviewDiagnostics(EnablePreview=True, rhinomcp_alias="diag", rhinomcp_graph_id="MCPGraph_20261017160928737")  # -> Diagnostics, ActiveBytes, LiveAllocations, DeviceName
number_slider = Slider(10, range=1..30)
number_slider_2 = Slider(5, range=-15..15)
box = CenterBox(
    Base=PlaneXY(0, 0, 0),
    X=number_slider,
    Y=number_slider,
    Z=number_slider,
    rhinomcp_alias="box",
    rhinomcp_graph_id="MCPGraph_20261017160928737")
pt = ConstructPoint(
    XCoordinate=number_slider_2,
    YCoordinate=number_slider_2,
    ZCoordinate=0,
    rhinomcp_alias="pt",
    rhinomcp_graph_id="MCPGraph_20261017160928737")
cyl = Cylinder(
    Base=PlaneXY(0, 0, 0),
    Radius=Slider(2.5, range=0.2..10),
    Length=1,
    rhinomcp_alias="cyl",
    rhinomcp_graph_id="MCPGraph_20261017160928737")
panel = Panel(gpudiag.Diagnostics)
sph = Sphere(Base=pt, Radius=Slider(6.5, range=0.5..20), rhinomcp_alias="sph", rhinomcp_graph_id="MCPGraph_20261017160928737")
gsint = SolidIntersectionGPU(BrepsA=box, BrepsB=sph, rhinomcp_alias="gint", rhinomcp_graph_id="MCPGraph_20261017160928737")
sint = SolidIntersection(BrepsA=box, BrepsB=sph, rhinomcp_alias="nint", rhinomcp_graph_id="MCPGraph_20261017160928737")

# ----
volume = BrepVolume(Brep=gsint, rhinomcp_alias="V_gint", rhinomcp_graph_id="MCPGraph_20261017160928737")  # -> Volume, Centroid
volume_2 = BrepVolume(Brep=sint, rhinomcp_alias="V_nint", rhinomcp_graph_id="MCPGraph_20261017160928737")  # -> Volume, Centroid
cap = CapHoles(Brep=cyl, rhinomcp_alias="cap", rhinomcp_graph_id="MCPGraph_20261017160928737")

# ---- group: Inputs: box, sphere, cylinder / GhostGPU hybrid booleans (GPU broadphase + winding classification) / Native Grasshopper booleans (reference) / GPU diagnostics (continued)
merge = Merge(Data1=sph, Data2=cap, rhinomcp_alias="cutters", rhinomcp_graph_id="MCPGraph_20261017160928737")
merge_2 = Merge(Data1=box, Data2=merge, rhinomcp_alias="uni_in", rhinomcp_graph_id="MCPGraph_20261017160928737")
gsdiff = SolidDifferenceGPU(BrepsA=box, BrepsB=merge, rhinomcp_alias="gdiff", rhinomcp_graph_id="MCPGraph_20261017160928737")
sdiff = SolidDifference(BrepsA=box, BrepsB=merge, rhinomcp_alias="ndiff", rhinomcp_graph_id="MCPGraph_20261017160928737")
gsunion = SolidUnionGPU(Breps=merge_2, rhinomcp_alias="guni", rhinomcp_graph_id="MCPGraph_20261017160928737")
sunion = SolidUnion(Breps=merge_2, rhinomcp_alias="nuni", rhinomcp_graph_id="MCPGraph_20261017160928737")

# ----
volume_3 = BrepVolume(Brep=gsdiff, rhinomcp_alias="V_gdiff", rhinomcp_graph_id="MCPGraph_20261017160928737")  # -> Volume, Centroid
volume_4 = BrepVolume(Brep=sdiff, rhinomcp_alias="V_ndiff", rhinomcp_graph_id="MCPGraph_20261017160928737")  # -> Volume, Centroid
volume_5 = BrepVolume(Brep=gsunion, rhinomcp_alias="V_guni", rhinomcp_graph_id="MCPGraph_20261017160928737")  # -> Volume, Centroid
volume_6 = BrepVolume(Brep=sunion, rhinomcp_alias="V_nuni", rhinomcp_graph_id="MCPGraph_20261017160928737")  # -> Volume, Centroid
